# Grasshopper definition 00_0 - The Orientation Principle.gh (Grasshopper 1.0.7)
# Copyright: Co-de-iT
# plug-ins: Human

# ---- group: receiving handle rotations
rotation_selector = Slider(0, range=0..2)
panel = Panel("""0
90
180""")
item = ListItem(List=panel, Index=rotation_selector, Wrap=True)

# ----
animate = Slider(0, range=0..1)

# ---- group: sender handle selection
crv = Curve([<curve referenced from the Rhino model> x3])
f_plp = PlaneFromLPolyline(P=crv)  # -> Pl; inputs P: Polyline
# ---------- f_plp: C# ----------
                                  /*
    froGH - a sparse collection of (in)utilities for Grasshopper

    Path Generator
    code by Alessio Erioli - value list generation based on code by James Ramsden

    froGH by Co-de-iT is licensed under a Creative Commons Attribution 4.0 International License.
    http://creativecommons.org/licenses/by/4.0/

    */
    initComp();
   
    if (P == null || P.Count != 3) return;

    Pl = new Plane(P[1], P[0], P[2]);
# ---------- f_plp: C# additional code ----------
  void initComp(){
    Component.Name = "Plane from L Polyline";
    Component.NickName = "f_PLP";
    Component.Description = "Generates a plane from al L shaped polyline (X-O-Y order)";
    Component.Params.Input[0].Name = "Polyline";
    Component.Params.Input[0].Description = "The L-shaped Polyline";
    Component.Params.Output[0].Name = "Plane";
    Component.Params.Output[0].Description = "The corresponding Plane";

  }
# ---------- end f_plp ----------
item_2 = ListItem(List=f_plp, Index="1", Wrap=True)

# ---- group: sender component mesh
# Rhino reference file: collision test dummies.3dm
mesh = Mesh(<mesh referenced from the Rhino model>)

# ----
# <title>
# 
# <description>
# 
# code by Alessio Erioli
# 
# v 0.1
# © Co-de-iT 2020 / Creative Commons Attribution-Non Commercial-ShareAlike 4.0 International License
planesrf = PlaneSurface(Plane=item_2, XSize="-2.5 to 2.5", YSize="-2.5 to 2.5")
preview = CustomPreview(Geometry=planesrf, Material=ColourSwatch(SwatchColor=RGB(255, 157, 0)))

# ---- group: receiving handles
rh_selector = Slider(0, range=0..3)
crv_2 = Curve([<curve referenced from the Rhino model> x4])
f_plp_2 = PlaneFromLPolyline(P=crv_2)  # -> Pl; inputs P: Polyline; same code as f_plp

# ----
pflip = FlipPlane(Plane=f_plp_2, ReverseX="true", ReverseY=False, SwapAxes=False)

# ---- group: receiving handles (continued)
item_3 = ListItem(List=pflip, Index=rh_selector, Wrap=True)
prot = RotatePlane(Plane=item_3, Angle=degrees(item))

# ----
planesrf_2 = PlaneSurface(Plane=prot, XSize="-2.5 to 2.5", YSize="-2.5 to 2.5")
cluster = Cluster(geo=mesh, pln=item_2, pln_2=prot, num=animate)  # -> C, G
preview_2 = CustomPreview(Geometry=planesrf_2, Material=ColourSwatch(SwatchColor=RGB(168, 12, 77)))
preview_3 = CustomPreview(Geometry=cluster.G, Material=ColourSwatch(SwatchColor=RGB(255, 255, 255)))
previewlw = CustomPreviewLineweights(Geometry=cluster.C, Shader=ColourSwatch(SwatchColor=RGB(120, 120, 120)), Absolute=False)

# ==== cluster Cluster
geo = ClusterInput()
pln = ClusterInput()
pln_2 = ClusterInput()
num = ClusterInput()
pln_3 = Plane(pln)
pln_4 = Plane(pln_2)
geo_2 = Geometry(geo)
num_2 = Number(num)
deplane = DeconstructPlane(Plane=pln_3)  # -> Origin, XAxis, YAxis, ZAxis
deplane_2 = DeconstructPlane(Plane=pln_4)  # -> Origin, XAxis, YAxis, ZAxis
rev = Reverse(Vector=deplane_2.ZAxis)
amp = Amplitude(Vector=deplane.ZAxis, Amplitude="50")
amp_2 = Amplitude(Vector=rev, Amplitude="50")
bzspan = BezierSpan(StartPoint=deplane.Origin, StartTangent=amp, EndPoint=deplane_2.Origin, EndTangent=amp_2)  # -> Curve, Length, Domain
expression = Expression(x=deplane.XAxis, y=deplane_2.XAxis, t=num_2, Expression="x*(1-t)+y*t")
C = ClusterOutput(bzspan.Curve)
pframe = PerpFrame(Curve=flatten(bzspan.Curve), Parameter=num_2)
align = AlignPlane(Plane=pframe, Direction=expression)  # -> Plane, Angle
orient = Orient(Geometry=geo_2, Source=pln_3, Target=align.Plane)  # -> Geometry, Transform
G = ClusterOutput(orient.Geometry)
