# Grasshopper definition 00_1 - Component Setup.gh (Grasshopper 1.0.7)
# Copyright: Co-de-iT

# ---- group: receiving handles rotation
# Rhino reference file: collision test dummies.3dm
panel = Panel("""0
180""")
panel_2 = Panel("""0
90
180""")

# ----
panel_3 = Panel("""0
90
180""")
entwine = Entwine(Branch00=panel_3, Branch01=panel_3, Branch02=panel_3, Branch03=panel_3, FlattenInputs=True)  # -> simplify(Result)
panel_4 = Panel("""1.0
1.0
1.0
1.0""")
panel_5 = Panel("""1
1
1
1""")
crv = Curve([<curve referenced from the Rhino model> x4])
mesh = Mesh(<mesh referenced from the Rhino model>)
volume = Volume(Geometry=mesh)  # -> Volume, Centroid
Y = UnitY(Factor=1)
name = Panel("elle")
xy = XYPlane(Origin=volume.Centroid)

entwine_2 = Entwine(Branch00=panel, Branch01=panel_2, Branch02=panel, FlattenInputs=True)  # -> simplify(Result)
panel_6 = Panel("""1.0
1.0
1.0""")
panel_7 = Panel("""0
1
0""")
crv_2 = Curve([<curve referenced from the Rhino model> x3])
explode = Explode(Curve=crv_2, Recursive=True)  # -> Segments, Vertices
f_plp = PlaneFromLPolyline(P=crv_2)  # -> Pl; inputs P: Polyline
# ---------- f_plp: C# ----------
                                  /*
    froGH - a sparse collection of (in)utilities for Grasshopper

    Path Generator
    code by Alessio Erioli - value list generation based on code by James Ramsden

    froGH by Co-de-iT is licensed under a Creative Commons Attribution 4.0 International License.
    http://creativecommons.org/licenses/by/4.0/

    */
    initComp();
   
    if (P == null || P.Count != 3) return;

    Pl = new Plane(P[1], P[0], P[2]);
# ---------- f_plp: C# additional code ----------
  void initComp(){
    Component.Name = "Plane from L Polyline";
    Component.NickName = "f_PLP";
    Component.Description = "Generates a plane from al L shaped polyline (X-O-Y order)";
    Component.Params.Input[0].Name = "Polyline";
    Component.Params.Input[0].Description = "The L-shaped Polyline";
    Component.Params.Output[0].Name = "Plane";
    Component.Params.Output[0].Description = "The corresponding Plane";

  }
# ---------- end f_plp ----------

# ---- group: create handles
c_script = CSharpScript(
    poly=graft(crv_2),
    rot=entwine_2,
    type=graft(panel_7),
    w=graft(panel_6),
    Reference="C:\Users\Alessio\AppData\Roaming\Grasshopper\Libraries\Assemblage.dll")  # -> out, flatten(H); inputs poly: Polyline, rot: list of Double, type: Int32, w: Double
# ---------- c_script: C# usings ----------
using Assemblage;
using System.Drawing;
# ---------- c_script: C# ----------
    Handle hand;
    if (rot == null || rot.Count == 0)
    {
      List < double > rotats = new List<double> {0.0};
      hand = new Handle(poly, type, w, rotats);
    }
    else
      hand = new Handle(poly, type, w, rot);

    for(int i = 0; i < rot.Count; i++)
    {
      Line rX = new Line(hand.r[i].Origin, hand.r[i].Origin + (hand.r[i].XAxis * 1.2));
      _curve.Add(rX);
     _color.Add(Color.Blue);
    }
    H = hand;
# ---------- c_script: C# additional code ----------
  private BoundingBox _clip;
  private List<Line> _curve = new  List<Line>();
  private List<Color> _color = new  List<Color>();

  /// <summary>
  /// This method will be called once every solution, before any calls to RunScript.
  /// </summary>
  public override void BeforeRunScript()
  {
    _clip = BoundingBox.Empty;
    _curve.Clear();
    _color.Clear();
  }
  /// <summary>
  /// This method will be called once every solution, after any calls to RunScript.
  /// </summary>
  public override void AfterRunScript()
  { }


  //Return a BoundingBox that contains all the geometry you are about to draw.
  public override BoundingBox ClippingBox
  {
    get {  return _clip;}
  }

  //Draw all meshes in this method.
  public override void DrawViewportMeshes(IGH_PreviewArgs args)
  {
  }

  //Draw all wires and points in this method.
  public override void DrawViewportWires(IGH_PreviewArgs args)
  {
    for(int i = 0; i < _curve.Count; i++)
      args.Display.DrawDottedLine(_curve[i], _color[i]);
  }
# ---------- end c_script ----------

c_script_2 = CSharpScript(
    poly=graft(crv),
    rot=entwine,
    type=graft(panel_5),
    w=graft(panel_4),
    Reference="C:\Users\Alessio\AppData\Roaming\Grasshopper\Libraries\Assemblage.dll")  # -> out, flatten(H); inputs poly: Polyline, rot: list of Double, type: Int32, w: Double; same code as c_script

# ----
points = PointList(Points=explode.Vertices, Size=".5")
points_2 = PointList(Points=f_plp, Size=".5")
mesh_2 = Mesh(<mesh referenced from the Rhino model>)
# <title>
# 
# <description>
# 
# code by Alessio Erioli
# 
# v 0.1
# © Co-de-iT 2020 / Creative Commons Attribution-Non Commercial-ShareAlike 4.0 International License
do_not_use = Panel("|=<%")
volume_2 = Volume(Geometry=mesh_2)  # -> Volume, Centroid
X = UnitX(Factor=1)
name_2 = Panel("stick")
xy_2 = XYPlane(Origin=volume_2.Centroid)

# ---- group: create assembly object
c_script_3 = CSharpScript(
    M=mesh,
    name=name,
    id="1",
    weight="1.0",
    direction=Y,
    Plane=xy,
    H=c_script_2.H,
    Reference="C:\Users\Alessio\AppData\Roaming\Grasshopper\Libraries\Assemblage.dll")  # -> AO; inputs M: Mesh, name: String, id: Int32, weight: Double, direction: Vector3d, Plane: Plane, H: list
# ---------- c_script_3: C# usings ----------
using System.Linq;
using Assemblage;
# ---------- c_script_3: C# ----------
    Handle[] handles = H.Select(h => (Handle) h).ToArray();
    AO = new AssemblyObject(M, handles, name, id, Plane, direction, weight);
# ---------- end c_script_3 ----------

c_script_4 = CSharpScript(
    M=mesh_2,
    name=name_2,
    id="0",
    weight="1.0",
    direction=X,
    Plane=xy_2,
    H=c_script.H,
    Reference="C:\Users\Alessio\AppData\Roaming\Grasshopper\Libraries\Assemblage.dll")  # -> AO; inputs M: Mesh, name: String, id: Int32, weight: Double, direction: Vector3d, Plane: Plane, H: list; same code as c_script_3

# ----
merge = Merge(Data1=c_script_4, Data2=c_script_3)

# ---- group: deconstruct Assembly Object
c_script_5 = CSharpScript(AO=c_script_4, Reference="C:\Users\Alessio\AppData\Roaming\Grasshopper\Libraries\Assemblage.dll")  # -> out, M, H, Pl, w, sc, dir
# ---------- c_script_5: C# usings ----------
using Assemblage;
# ---------- c_script_5: C# ----------
    if (AO == null) return;
    AssemblyObject o = (AssemblyObject) AO;

    M = o.coarseMesh;
    H = o.handles;
    Pl = o.referencePlane;
    w = o.weight;
    sc = o.scalar;
    dir = o.direction;
# ---------- end c_script_5 ----------

# ----
# M  - mesh
# H - handles
# Pl - reference plane
# w - weight
# sc - scalar
# dir - direction
panel_8 = Panel(c_script_5.M)
panel_9 = Panel(c_script_5.w)
panel_10 = Panel(c_script_5.Pl)
panel_11 = Panel(c_script_5.sc)
panel_12 = Panel(c_script_5.dir)

# ---- group: deconstruct handle
c_script_6 = CSharpScript(H=c_script_5.H, Reference="C:\Users\Alessio\AppData\Roaming\Grasshopper\Libraries\Assemblage.dll")  # -> out, sP, rP, rot, w, hO, nH, type
# ---------- c_script_6: C# ----------
    if (H == null) return;
    Handle h = (Handle) H;
    sP = h.s;
    rP = h.r;
    rot = h.rRotations;
    w = h.weight;
    hO = h.occupancy;
    nH = h.neighbourHandle;
    //nInd = h.neighbourIndex;
    type = h.type;
# ---------- end c_script_6 ----------

# ----
# sP - sender planes
# rP - receiver planes
# - receiver rotations
# w - weight
# hO - handle occupancy
# nH - neighbour handle
# type - handle type
panel_13 = Panel(c_script_6.sP)
panel_14 = Panel(c_script_6.rP)
panel_15 = Panel(c_script_6.rot)
panel_16 = Panel(c_script_6.w)
panel_17 = Panel(c_script_6.hO)
panel_18 = Panel(c_script_6.nH)
panel_19 = Panel(c_script_6.type)
