# Grasshopper definition 01 - Heuristic Setup.gh (Grasshopper 1.0.7)
# Copyright: Co-de-iT
# plug-ins: Human, SelectablePreview

# ---- group: receiving handles rotation
# Rhino reference file: collision test dummies.3dm
panel = Panel("""0
180""")
panel_2 = Panel("""0
90
180""")

# ----
panel_3 = Panel("""0
90
180""")
entwine = Entwine(Branch00=panel, Branch01=panel_2, Branch02=panel, FlattenInputs=True)  # -> simplify(Result)
entwine_2 = Entwine(Branch00=panel_3, Branch01=panel_3, Branch02=panel_3, Branch03=panel_3, FlattenInputs=True)  # -> simplify(Result)
panel_4 = Panel("""1.0
1.0""")
panel_5 = Panel("""1.0
1.0
1.0
1.0""")
panel_6 = Panel("""0
1
0""")
panel_7 = Panel("""1
1
1
1""")
crv = Curve([<curve referenced from the Rhino model> x3])
crv_2 = Curve([<curve referenced from the Rhino model> x4])

# ---- group: create handles
c_script = CSharpScript(
    poly=graft(crv),
    rot=entwine,
    type=graft(panel_6),
    w=graft(panel_4),
    Reference="C:\Users\Alessio\AppData\Roaming\Grasshopper\Libraries\Assemblage.dll")  # -> out, flatten(H); inputs poly: Polyline, rot: list of Double, type: Int32, w: Double
# ---------- c_script: C# usings ----------
using Assemblage;
using System.Drawing;
# ---------- c_script: C# ----------
    Handle hand;
    if (rot == null || rot.Count == 0)
    {
      List < double > rotats = new List<double> {0.0};
      hand = new Handle(poly, type, w, rotats);
    }
    else
      hand = new Handle(poly, type, w, rot);

    for(int i = 0; i < rot.Count; i++)
    {
      Line rX = new Line(hand.r[i].Origin, hand.r[i].Origin + (hand.r[i].XAxis * 1.2));
      _curve.Add(rX);
     _color.Add(Color.Blue);
    }
    H = hand;
# ---------- c_script: C# additional code ----------
  private BoundingBox _clip;
  private List<Line> _curve = new  List<Line>();
  private List<Color> _color = new  List<Color>();

  /// <summary>
  /// This method will be called once every solution, before any calls to RunScript.
  /// </summary>
  public override void BeforeRunScript()
  {
    _clip = BoundingBox.Empty;
    _curve.Clear();
    _color.Clear();
  }
  /// <summary>
  /// This method will be called once every solution, after any calls to RunScript.
  /// </summary>
  public override void AfterRunScript()
  { }


  //Return a BoundingBox that contains all the geometry you are about to draw.
  public override BoundingBox ClippingBox
  {
    get {  return _clip;}
  }

  //Draw all meshes in this method.
  public override void DrawViewportMeshes(IGH_PreviewArgs args)
  {
  }

  //Draw all wires and points in this method.
  public override void DrawViewportWires(IGH_PreviewArgs args)
  {
    for(int i = 0; i < _curve.Count; i++)
      args.Display.DrawDottedLine(_curve[i], _color[i]);
  }
# ---------- end c_script ----------

c_script_2 = CSharpScript(
    poly=graft(crv_2),
    rot=entwine_2,
    type=graft(panel_7),
    w=graft(panel_5),
    Reference="C:\Users\Alessio\AppData\Roaming\Grasshopper\Libraries\Assemblage.dll")  # -> out, flatten(H); inputs poly: Polyline, rot: list of Double, type: Int32, w: Double; same code as c_script

# ----
mesh = Mesh(<mesh referenced from the Rhino model>)
# © Co-de-iT 2020 / Creative Commons Attribution-Non Commercial-ShareAlike 4.0 International License
mesh_2 = Mesh(<mesh referenced from the Rhino model>)
volume = Volume(Geometry=mesh_2)  # -> Volume, Centroid
volume_2 = Volume(Geometry=mesh)  # -> Volume, Centroid
X = UnitX(Factor=1)
Y = UnitY(Factor=1)
# <title>
# 
# <description>
# 
# code by Alessio Erioli
# 
# v 0.1
name = Panel("stick")
name_2 = Panel("elle")
xy = XYPlane(Origin=volume.Centroid)
xy_2 = XYPlane(Origin=volume_2.Centroid)

# ---- group: create assembly object
c_script_3 = CSharpScript(
    M=mesh,
    name=name_2,
    id="1",
    weight="1.0",
    direction=Y,
    Plane=xy_2,
    H=c_script_2.H,
    Reference="C:\Users\Alessio\AppData\Roaming\Grasshopper\Libraries\Assemblage.dll")  # -> AO; inputs M: Mesh, name: String, id: Int32, weight: Double, direction: Vector3d, Plane: Plane, H: list
# ---------- c_script_3: C# usings ----------
using System.Linq;
using Assemblage;
# ---------- c_script_3: C# ----------
    Handle[] handles = H.Select(h => (Handle) h).ToArray();
    AO = new AssemblyObject(M, handles, name, id, Plane, direction, weight);
# ---------- end c_script_3 ----------

c_script_4 = CSharpScript(
    M=mesh_2,
    name=name,
    id="0",
    weight="1.0",
    direction=X,
    Plane=xy,
    H=c_script.H,
    Reference="C:\Users\Alessio\AppData\Roaming\Grasshopper\Libraries\Assemblage.dll")  # -> AO; inputs M: Mesh, name: String, id: Int32, weight: Double, direction: Vector3d, Plane: Plane, H: list; same code as c_script_3

# ----
merge = Merge(Data1=c_script_4, Data2=c_script_3)
panel_8 = Panel("AOs - AssemblyObject set")

# ----
# selfC - avoid same type component connection
# 
# selfH - avoid same type handle connection
# 
# symm - avoid symmetric rules
symm = BooleanToggle(False)
selfh = BooleanToggle(False)
selfc = BooleanToggle(False)

# ---- group: Heuristic Writer
c_script_5 = CSharpScript(
    AOs=merge,
    selfC=selfc,
    selfH=selfh,
    symm=symm,
    Reference="C:\Users\Alessio\AppData\Roaming\Grasshopper\Libraries\Assemblage.dll")  # -> out, HeS; inputs AOs: list, selfC: Boolean, selfH: Boolean, symm: Boolean
# ---------- c_script_5: C# usings ----------
using System.Linq;
using Rhino.Geometry.Intersect;
using System.Threading.Tasks;
using Assemblage;
# ---------- c_script_5: C# ----------
    // cast input to AssemblyObject type
    components = AOs.Select(ao => (AssemblyObject) ao).ToArray();

    // Build Component catalog
    catalog = BuildCatalog(components);

    // check if no input is connected to input slot 2
    //if (Component.Params.Input.ElementAt(1).SourceCount == 0) throw new Exception("no selfC");

    // selfC and selfH are flags to avoid connecting a component type to self or a specific handle to itself
    // symm filters symmetric combinations

    string[] Heuristics;
    /*Her=*/ HeuristicsWriter(components, selfC, selfH, symm, out Heuristics);
    HeS = Heuristics;

    //D = catalog;
# ---------- c_script_5: C# additional code ----------
  public Dictionary<string, int> catalog;
  public AssemblyObject[] components;

  public Dictionary<string, int> BuildCatalog(AssemblyObject[] components)
  {
    Dictionary<string, int> cat = new Dictionary<string, int>();

    for(int i = 0; i < components.Length; i++)
      components[i].id = i;
    
    foreach (AssemblyObject ao in components)
      cat.Add(ao.name, ao.id);

    return cat;
  }

  public DataTree<Rule> HeuristicsWriter(AssemblyObject[] components, bool selfC, bool selfH, bool symm, out string[] heu)
  {
    DataTree<Rule> heuT = new DataTree<Rule>();
    List<string> hsList = new List<string>();
    string hs;
        /*
         sCi - receiver components index
         rHi - receiver handle index
         sCi - sender component index
         sHi - sender handle index
         rRi - receiver rotation index
         */
        // scan all components as potential receivers
    for (int rCi = 0; rCi < components.Length; rCi++)
    {

      // scan all handles
      for (int rHi = 0; rHi < components[rCi].handles.Length; rHi++)
      {
        // scan all components as potential senders
        for (int sCi = 0; sCi < components.Length; sCi++)
        {
          // exclude self if selfC is True
          if (rCi == sCi && selfC) continue;
          // scan potential sender handles
          for (int sHi = 0; sHi < components[sCi].handles.Length; sHi++)
          {
            // exclude handles attaching to self if selfH is True
            if (rCi == sCi && rHi == sHi && selfH) continue;
            // if handle types match generate heuristic
            if (components[rCi].handles[rHi].type == components[sCi].handles[sHi].type)
            {
              // consider all receiver rotations
              for (int rRi = 0; rRi < components[rCi].handles[rHi].r.Length; rRi++)
              {
                Rule newRule = new Rule(rCi, rHi, rRi, sCi, sHi);
                if (!symm || !HasSymmetric(newRule, heuT))
                {
                  heuT.Add(newRule, new GH_Path(rCi));
                  hs = string.Format("{0}|{1}={2}<{3}|{4}%0", components[rCi].name, rHi, rRi, components[sCi].name, sHi);
                  hsList.Add(hs);
                }
              }
            }
          }
        }
      }
    }
    //hs = hs.TrimEnd(new[] { ',' });
    heu = hsList.ToArray();

    return heuT;
  }

  bool HasSymmetric(Rule r, DataTree<Rule> heuT)
  {
    // return if there are less than 1 rules in the tree
    List<Rule> allRules = heuT.AllData();
    if (allRules.Count < 1) return false;

        /*
         rule symmetry condition:

        rule r and rule r1 are symmetric if:

        . rT = sT1
        . sT = rT1
        . rH = sH1
        . sH = rH1
        . rR = rR1 (true angles, not indices - retrieve rotation angles)
         */

    double angle0, angle1;
    angle0 = components[r.rT].handles[r.rH].rRotations[r.rR];

    foreach (Rule r1 in allRules)
    {
      if (r.rT == r1.sT && r.sT == r1.rT && r.rH == r1.sH && r.sH == r1.rH)
      {
        angle1 = components[r1.rT].handles[r1.rH].rRotations[r1.rR];
        if (angle0 == angle1) return true;
      }
    }

    return false;
  }

  DataTree<Rule> HeuristicsRulesFromString(int hN, string heu)
  {
    DataTree<Rule> heuT = new DataTree<Rule>();
    //          split by list of rules (,)
    string[] rComp = heu.Split(new[] { ',' });

    int rT, rH, rR, sT, sH;
    for (int i = 0; i < rComp.Length; i++)
    {
      string[] rule = rComp[i].Split(new[] { '<' });
      string[] rec = rule[0].Split(new[] { '|' });
      string[] sen = rule[1].Split(new[] { '|' });
      // sender and receiver component types
      sT = catalog[sen[0]];
      rT = catalog[rec[0]];
      // sender handle index
      sH = Convert.ToInt32(sen[1]);

      string[] rRot = rec[1].Split(new[] { '=' });
      // receiver handle index and rotation
      rH = Convert.ToInt32(rRot[0]);
      rR = Convert.ToInt32(rRot[1]);

      heuT.Add(new Rule(rT, rH, rR, sT, sH), new GH_Path(hN, rT));
    }

    return heuT;
  }
# ---------- end c_script_5 ----------

# ----
panel_9 = Panel("HeS - Heuristics String")

# ---- group: grid parameters
number_slider = Slider(1.3, range=1..2)
number_slider_2 = Slider(1.5, range=1..2)
number_slider_3 = Slider(9, range=1..10)

# ---- group: base point
pt = Point(Point(-124.6236273, 0, 0))

# ----
panel_10 = Panel(c_script_5.HeS)

ia_heview = HeuristicsViewer(
    P=pt,
    AOs=merge,
    HeS=c_script_5.HeS,
    padX=number_slider,
    padY=number_slider_2,
    nR=number_slider_3,
    Reference="C:\Users\Alessio\AppData\Roaming\Grasshopper\Libraries\Assemblage.dll")  # -> out, AOc, HeST, Tp, Tt, Cp; inputs P: Point3d, AOs: list, HeS: list of String, padX: Double, padY: Double, nR: Int32
# ---------- ia_heview: C# usings ----------
using System.Linq;
using Rhino.Geometry.Intersect;
using System.Threading.Tasks;
using Assemblage;
using System.Reflection;
using Rhino.Render;
# ---------- ia_heview: C# ----------
    InitComp();

    if (P == null) P = new Point3d();

    // cast input to AssemblyObject type
    AssemblyObject[] components = AOs.Select(ao => (AssemblyObject) ao).ToArray();

    // Build Component catalog
    catalog = BuildCatalog(components);

    // Build Heuristics Tree
    DataTree<string> HeSTree; // heuristics string in tree format for manual selection in GH
    DataTree<Rule> HeR = HeuristicsRulesFromString(HeS, out HeSTree);

    geometries = Visualizer(components, HeR, P, padX, padY, nR, out textLocations, out text, out consistency);

    AOc = geometries;
    HeST = HeSTree;
    Tp = textLocations;
    Tt = text;
    // Cp is the consistency pattern (true if ok, false if collision detected)
    Cp = consistency;
# ---------- ia_heview: C# additional code ----------
  public Dictionary<string, int> catalog;
  DataTree<AssemblyObject> geometries;
  DataTree<Point3d> textLocations;
  DataTree<Point3d> bbCenters;
  DataTree<string> text;
  DataTree<bool> consistency;

  public void InitComp()
  {
    Component.Name = "Heuristics Viewer";
    Component.NickName = "IA_HeView";
    Component.Description = "Visualize Heuristics (combinatorial rules) for assemblages as a table";
    Component.Params.Input[0].Name = "Origin Point";
    Component.Params.Input[0].Description = "Lower-left origin point for combination table";
    Component.Params.Input[1].Name = "Assembly Objects Set";
    Component.Params.Input[1].Description = "Set of AssemblyObject unique types";
  }

  public Dictionary<string, int> BuildCatalog(AssemblyObject[] components)
  {
    Dictionary<string, int> cat = new Dictionary<string, int>();

    foreach (AssemblyObject ao in components)
      cat.Add(ao.name, ao.id);
    
    for(int i = 0; i < components.Length; i++)
      components[i].id = i;

    return cat;
  }

  DataTree<Rule> HeuristicsRulesFromString(List<string> heu, out DataTree<string> heS)
  {
    DataTree<Rule> heuT = new DataTree<Rule>();
    heS = new DataTree<string>();
    //          split by list of rules (,)
    //string[] rComp = heu.Split(new[] { ',' });
    string[] rComp = heu.ToArray();

    int rT, rH, rR, sT, sH;
    int w;
    for (int i = 0; i < rComp.Length; i++)
    {
      string[] rule = rComp[i].Split(new[] { '<','%' });
      string[] rec = rule[0].Split(new[] { '|' });
      string[] sen = rule[1].Split(new[] { '|' });
      // sender and receiver component types
      sT = catalog[sen[0]];
      rT = catalog[rec[0]];
      // sender handle index
      sH = Convert.ToInt32(sen[1]);
      // weight
      w = Convert.ToInt32(rule[2]);
      string[] rRot = rec[1].Split(new[] { '=' });
      // receiver handle index and rotation
      rH = Convert.ToInt32(rRot[0]);
      rR = Convert.ToInt32(rRot[1]);

      heuT.Add(new Rule(rT, rH, rR, sT, sH, w), new GH_Path(rT));
      heS.Add(rComp[i], new GH_Path(rT));
    }
    heS.Graft();
    return heuT;
  }

  //public DataTree<AssemblyObject> Visualizer(AssemblyObject[] AO, DataTree<int> He, Point3d O, double sX, double sY, int nR,
  //    out DataTree<Point3d> textLocations, out DataTree<string> text, out DataTree<bool> consistency)
  //{
  //    DataTree<AssemblyObject> geometries = new DataTree<AssemblyObject>();
  //    textLocations = new DataTree<Point3d>();
  //    text = new DataTree<string>();
  //    consistency = new DataTree<bool>();

  //    int rT, rH, sT, sH;
  //    int[] rR;
  //    Point3d loc;

  //    int countY = 0, countX = 0;
  //    int total = He.AllData().Count;
  //    int rowElements = total / nR;
  //    AssemblyObject sender, receiver;

  //    for (int i = 0; i < He.BranchCount; i++)
  //    {

  //        int[] ind = He.Paths[i].Indices;
  //        rT = ind[1];
  //        rH = ind[2];
  //        sT = ind[3];
  //        sH = ind[4];
  //        rR = He.Branches[i].ToArray();

  //        for (int j = 0; j < rR.Length; j++)
  //        {
  //            // define location
  //            loc = O + new Point3d(sX * (countX + 0.5), sY * (countY + 0.5), 0);

  //            // choose components and orient by rule
  //            receiver = new AssemblyObject(AO[rT]);
  //            sender = new AssemblyObject(AO[sT]);
  //            // transfer receiver component
  //            Transform move = Transform.Translation(loc - receiver.referencePlane.Origin);
  //            receiver.Transform(move);
  //            // orient sender component
  //            Transform orient = Transform.PlaneToPlane(sender.handles[sH].s, receiver.handles[rH].r[j]);
  //            sender.Transform(orient);
  //            // rewrite rule
  //            string rule = receiver.name + "|" + rH + "=" + j + "(" + receiver.handles[rH].rRotations[j] + ")" + "<" + sender.name + "|" + sH;

  //            // add geometries to DataTree - same path of heuristic + one more index for rotations
  //            geometries.Add(receiver, He.Paths[i].AppendElement(j));
  //            geometries.Add(sender, He.Paths[i].AppendElement(j));
  //            textLocations.Add(loc + new Point3d(0, -0.45 * sY, 0), He.Paths[i].AppendElement(j));
  //            consistency.Add(!CollisionCheck(receiver, sender), He.Paths[i].AppendElement(j));
  //            text.Add(rule, He.Paths[i].AppendElement(j));
  //            countY++;
  //            if (countY % rowElements == 0)
  //            {
  //                countY = 0;
  //                countX++;
  //            }
  //        }
  //    }
  //    return geometries;
  //}

  public DataTree<AssemblyObject> Visualizer(AssemblyObject[] AO, DataTree<Rule> Hr, Point3d O, double padX, double padY, int nR,
    out DataTree<Point3d> textLocations, out DataTree<string> text, out DataTree<bool> consistency)
  {
    DataTree<AssemblyObject> geometries = new DataTree<AssemblyObject>();
    textLocations = new DataTree<Point3d>();
    bbCenters = new DataTree<Point3d>();
    text = new DataTree<string>();
    consistency = new DataTree<bool>();

    double sX = 0, sY = 0, sZ = 0;

    int rT, rH, sT, sH, rR;
    Point3d loc;

    int countY = 0, countX = 0;
    int total = Hr.AllData().Count;
    int rowElements = (total / nR) + 1;
    AssemblyObject sender, receiver;


    // sequence
    // loop 1:
    // record point grid position (countX, countY)
    // create copies of AOs
    // orient sender to receiver according to rule and add to geometries Tree
    // calculate Bounding Box size and compare to sX, sY, sZ (retain maximum)

    for (int i = 0; i < Hr.BranchCount; i++)
    {

      Rule[] rules = Hr.Branches[i].ToArray();
      rT = Hr.Paths[i].Indices[0];

      for (int j = 0; j < rules.Length; j++)
      {
        // extract rule parameters
        rH = rules[j].rH;
        sT = rules[j].sT;
        sH = rules[j].sH;
        rR = rules[j].rR;

        // define location as point grid position (countX, countY)
        loc = new Point3d(countX, countY, 0);

        // choose components
        receiver = new AssemblyObject(AO[rT]);
        sender = new AssemblyObject(AO[sT]);
        // orient sender to receiver
        Transform orient = Transform.PlaneToPlane(sender.handles[sH].s, receiver.handles[rH].r[rR]);
        sender.Transform(orient);

        // calculate Bounding Box and compare size to initial parameters
        //BoundingBox bb = new BoundingBox();
        BoundingBox bb = receiver.coarseMesh.GetBoundingBox(false);
        bb.Union(sender.coarseMesh.GetBoundingBox(false));
        // record center plane of AO combination
        bbCenters.Add(bb.Center, Hr.Paths[i].AppendElement(j));

        sX = Math.Max(sX, bb.Diagonal.X);
        sY = Math.Max(sY, bb.Diagonal.Y);
        sZ = Math.Max(sZ, bb.Diagonal.Z);

        // add AssemblyObjects to DataTree - same path of heuristic + one more index for rotations
        geometries.Add(receiver, Hr.Paths[i].AppendElement(j));
        geometries.Add(sender, Hr.Paths[i].AppendElement(j));
        // add point grid location to tree
        textLocations.Add(loc, Hr.Paths[i].AppendElement(j));
        // fill other output data with same path as AssemblyObjects DataTree
        consistency.Add(!CollisionCheck(receiver, sender), Hr.Paths[i].AppendElement(j));
        // rewrite rule for display and add to the text Tree
        string rule = receiver.name + "|" + rH + "=" + rR + "(" + receiver.handles[rH].rRotations[rR] + ")" + "<" + sender.name + "|" + sH;
        text.Add(rule, Hr.Paths[i].AppendElement(j));

        // calculate next grid position
        countX++;
        if (countX % rowElements == 0)
        {
          countX = 0;
          countY++;
        }
      }
    }

    // loop2:
    // scale point grid positions by final sX, sY, sZ
    // move all AOs in the geometries Tree in position
    for (int i = 0; i < geometries.BranchCount; i++)
    {
      Point3d newLoc = textLocations.Branches[i][0];
      newLoc.X = O.X + (newLoc.X + 0.5) * sX * padX;
      newLoc.Y = O.Y + (newLoc.Y + 0.5) * sY * padY;
      newLoc.Z = O.Z + sZ * 0.5;
      Point3d textLoc = new Point3d(newLoc.X, newLoc.Y - 0.45 * sY, 0);
      // record final text position
      textLocations.Branches[i][0] = textLoc;

      // transfer components
      Transform move = Transform.Translation(newLoc - bbCenters.Branches[i][0]);
      foreach (AssemblyObject ao in geometries.Branches[i])
        ao.Transform(move);
    }
    return geometries;
  }

  public bool CollisionCheck(AssemblyObject receiver, AssemblyObject sender)
  {
    if (Intersection.MeshMeshFast(receiver.coarseMesh, sender.collisionMesh).Length == 0)
      if (receiver.referencePlane.Origin.DistanceToSquared(sender.referencePlane.Origin) > 0.01)
        return false;
    return true;
  }
# ---------- end ia_heview ----------

# ---- group: deconstruct rule string
c_script_6 = CSharpScript(Rs=c_script_5.HeS, Reference="C:\Users\Alessio\AppData\Roaming\Grasshopper\Libraries\Assemblage.dll")  # -> out, rT, rH, rR, sT, sH, w; inputs Rs: String
# ---------- c_script_6: C# ----------
    string[] r = Rs.Split(new []{'|', '=', '<', '%'});
    rT = r[0];
    rH = r[1];
    rR = r[2];
    sT = r[3];
    sH = r[4];
    w = r[5];
# ---------- end c_script_6 ----------

# ---- group: extract collision geometry
c_script_7 = CSharpScript(AO=ia_heview.AOc, Reference="C:\Users\Alessio\AppData\Roaming\Grasshopper\Libraries\Assemblage.dll")  # -> M
# ---------- c_script_7: C# usings ----------
using Assemblage;
# ---------- c_script_7: C# ----------
    if (AO == null) return;
    AssemblyObject o = (AssemblyObject) AO;

    M = o.coarseMesh;
# ---------- end c_script_7 ----------

# ----
item = ListItem(List=panel_10, Index="15", Wrap=True)
heuristic_rule_syntax = Panel(item)

# ---- group: filter valid combinations
dispatch = Dispatch(List=ia_heview.HeST, DispatchPattern=ia_heview.Cp)  # -> ListA, ListB
dispatch_2 = Dispatch(List=c_script_7, DispatchPattern=ia_heview.Cp)  # -> ListA, ListB

# ---- group: manually select heuristics
selpv = SelectablePreview(
    Geometry=dispatch_2.ListA,
    lock=True,
    maintain=False,
    order=False,
    selectedobject="13|1|17|30|40|38|58|46|52|29|25|27|23|34|33")  # -> Geometry, Path, Index

# ---- group: display valid/invalid
invalid = ColourSwatch(SwatchColor=RGB(255, 0, 0))
valid = ColourSwatch(SwatchColor=RGB(0, 0, 0))
f_mseea = MeshExtractEdgesWithToleranceAngle(M=c_script_7, A="45")  # -> Ei, En; inputs M: Mesh, A: Double
# ---------- f_mseea: C# usings ----------
using System.Threading.Tasks;
using System.Collections.Concurrent;
using System.Linq;
# ---------- f_mseea: C# ----------
    
          /*
    froGH - a sparse collection of (in)utilities for Grasshopper

    Mesh Extract Edges with tolerance angle - single mesh

    code by Alessio Erioli

    froGH by Co-de-iT is licensed under a Creative Commons Attribution 4.0 International License.
    http://creativecommons.org/licenses/by/4.0/

    */

    InitComp();

    if (M == null) return;
    
    double num = A / 57.2958;

    ConcurrentBag<GH_Line> list = new ConcurrentBag<GH_Line>();
    ConcurrentBag<GH_Line> list2 = new ConcurrentBag<GH_Line>();


    M.Normals.ComputeNormals();
    Rhino.Geometry.Collections.MeshTopologyEdgeList topologyEdges = M.TopologyEdges;

    int num2 = topologyEdges.Count - 1;
    Parallel.For(0, topologyEdges.Count, i =>
      //for (int i = 0; i <= num2; i++)
      {
      int[] connectedFaces = topologyEdges.GetConnectedFaces(i);
      if (connectedFaces.Length < 2)
        list2.Add(new GH_Line(topologyEdges.EdgeLine(i)));

      if (connectedFaces.Length == 2)
      {
        Vector3f val2 = M.FaceNormals[connectedFaces[0]];
        Vector3f val3 = M.FaceNormals[connectedFaces[1]];
        double num3 = Vector3d.VectorAngle(new Vector3d((double) val2.X, (double) val2.Y, (double) val2.Z),
          new Vector3d((double) val3.X, (double) val3.Y, (double) val3.Z));
        if (num3 > num)
          list.Add(new GH_Line(topologyEdges.EdgeLine(i)));

      }
      });

    Ei = list;
    En = list2;
# ---------- f_mseea: C# additional code ----------
  private void InitComp(){
    Component.Name = "Mesh Extract Edges with tolerance angle";
    Component.NickName = "f_MsEEA";
    Component.Description = "Extract Mesh edges with specific angle tolerance.\n\nOptimized for a single mesh";
    Component.Params.Input[0].Name = "Mesh";
    Component.Params.Input[0].Description = "The Input Mesh to process";
    Component.Params.Input[1].Name = "Angle";
    Component.Params.Input[1].Description = "The Tolerance Angle";
    Component.Params.Output[0].Name = "Internal Edges";
    Component.Params.Output[0].Description = "Internal edges lines under tolerance";
    Component.Params.Output[1].Name = "Naked Edges";
    Component.Params.Output[1].Description = "Naked edges lines";
  }
# ---------- end f_mseea ----------
weave = Weave(Pattern=ia_heview.Cp, Stream0=invalid, Stream1=valid, NullGaps=False)
weave_2 = Weave(Pattern=ia_heview.Cp, Stream0="3", Stream1="1", NullGaps=False)
pshift = ShiftPaths(Data=f_mseea.Ei, Offset=-1)
previewlw = CustomPreviewLineweights(Geometry=pshift, Shader=weave, Thickness=weave_2, Absolute=False)
tag = TextTag3D(Location=ia_heview.Tp, Text=ia_heview.Tt, Size="2", Colour=weave, Justification=8)

# ----
assemblage_rules = ValueList({"Full": 0, "Manual": 1}, selected="Full")
cset = CreateSet(List=selpv.Path)  # -> Set, Map
branch = TreeBranch(Tree=dispatch_2.ListA, Path=cset.Set, MaintainPaths=True)
branch_2 = TreeBranch(Tree=dispatch.ListA, Path=cset.Set, MaintainPaths=True)

sen = ColourSwatch(SwatchColor=RGB(201, 165, 34))
rec = ColourSwatch(SwatchColor=RGB(201, 60, 133))

filter = StreamFilter(Gate=assemblage_rules, Stream0=dispatch_2.ListA, Stream1=branch)
merge_2 = Merge(Data1=rec, Data2=sen)
filter_2 = StreamFilter(Gate=assemblage_rules, Stream0=flatten(dispatch.ListA), Stream1=flatten(branch_2))
preview = CustomPreview(Geometry=filter, Material=merge_2)

panel_11 = Panel("manual pick_01.txt")
panel_12 = Panel("full heuristics.txt")
panel_13 = Panel("full_noSelfH.txt")
f_ghfilepath = GHFilePathInfo()  # -> F, P
# ---------- f_ghfilepath: C# ----------
                                      /*
    froGH - a sparse collection of (in)utilities for Grasshopper

    GH File and Path info

    code by Alessio Erioli

    froGH by Co-de-iT is licensed under a Creative Commons Attribution 4.0 International License.
    http://creativecommons.org/licenses/by/4.0/

    */

    initComp();

    GH_Document ghDoc = Grasshopper.Instances.ActiveCanvas.Document;

    int nameLen = ghDoc.DisplayName.TrimEnd('*').Length + 3; // +3 accounts for the '.gh' extension
    int fileLen = ghDoc.FilePath.TrimEnd('*').Length;

    F = ghDoc.DisplayName.TrimEnd('*');
    P = ghDoc.FilePath.Substring(0, fileLen - nameLen);
# ---------- f_ghfilepath: C# additional code ----------
  void initComp(){

    Component.Name = "GH File Path Info";
    Component.NickName = "f_GHFilePath";
    Component.Description = "Provides info on current Grasshopper Document file name and path\nUseful for exporting files with the same name as the gh file and in the same directory";
    Component.Params.Output[0].Name = "File Name";
    Component.Params.Output[0].Description = "Current GH file name";
    Component.Params.Output[1].Name = "File Path";
    Component.Params.Output[1].Description = "Current GH file path";
  }
# ---------- end f_ghfilepath ----------
save = Button()
concat = Concatenate(FragmentA=f_ghfilepath.P, FragmentB="heuristics\")
txt = Text(filter_2)
f_str2file = SaveStringToFile(S=txt, dir=concat, file="full_noSelfC_symm.txt", save=save)  # -> info; inputs S: list of String, dir: String, file: String, save: Boolean
# ---------- f_str2file: C# usings ----------
using System.IO;
# ---------- f_str2file: C# ----------
                               /*
    froGH - a sparse collection of (in)utilities for Grasshopper

    Save string to file

    code by Alessio Erioli

    froGH by Co-de-iT is licensed under a Creative Commons Attribution 4.0 International License.
    http://creativecommons.org/licenses/by/4.0/

    */

    initComp();



    if (save){
      if (!Directory.Exists(dir)) Directory.CreateDirectory(dir);

      String target = dir + file;

      System.IO.File.WriteAllLines(target, S.ToArray());
      info = "file saved as: " + target;
    } else {
      info = "press save button to save file";
    }
# ---------- f_str2file: C# additional code ----------
  void initComp(){
    Component.Name = "Save String to File";
    Component.NickName = "f_Str2File";
    Component.Description = "Saves a text sequence to a file";

    Component.Params.Input[0].Name = "String";
    Component.Params.Input[0].Description = "string to save (as List)";
    Component.Params.Input[1].Name = "directory";
    Component.Params.Input[1].Description = "directory where the string file is saved";
    Component.Params.Input[2].Name = "fileName";
    Component.Params.Input[2].Description = "file name and extension (ex: myText.txt)";
    Component.Params.Input[3].Name = "save";
    Component.Params.Input[3].Description = "activate saving - attach a button and click to save";
    Component.Params.Output[0].Name = "info";
    Component.Params.Output[0].Description = "information on the saving process";
  }
# ---------- end f_str2file ----------

panel_14 = Panel(f_str2file)
