# Grasshopper definition 04_0 - Field stand alone.gh (Grasshopper 1.0.7)
# Copyright: Co-de-iT
# plug-ins: MeshEdit Components, Human

# ---- group: box geometry for field
# Rhino reference file: collision test dummies.3dm
number_slider = Slider(181.254, range=0..200)
pt = Point(Point(113.039803, 95.03071659, 0))
# <title>
# 
# <description>
# 
# code by Alessio Erioli
# 
# v 0.1
# © Co-de-iT 2020 / Creative Commons Attribution-Non Commercial-ShareAlike 4.0 International License
box = CenterBox(Base=pt, X=number_slider, Y=Slider(96.963, range=0..200), Z=Slider(96.963, range=0..200))
mbox = MeshBox(Base=box, XCount="1", YCount="1", ZCount="1")
flip = MeshFlip(Mesh=mbox)
weldvertices = MeshWeldVertices(Mesh=flip, Tolerance=0.01)  # -> RuntimeMessage, Mesh

# ---- group: curve attractor
crv = Curve(<curve referenced from the Rhino model>)
previewlw = CustomPreviewLineweights(Geometry=crv, Shader=ColourSwatch(SwatchColor=RGB(255, 0, 0)), Thickness="3", Absolute=False)

# ---- group: extract edges with angle tolerance (single mesh)
f_mseea = MeshExtractEdgesWithToleranceAngle(M=weldvertices.Mesh, A="5")  # -> flatten(Ei), En; inputs M: Mesh, A: Double
# ---------- f_mseea: C# usings ----------
using System.Threading.Tasks;
using System.Collections.Concurrent;
using System.Linq;
# ---------- f_mseea: C# ----------
    
          /*
    froGH - a sparse collection of (in)utilities for Grasshopper

    Mesh Extract Edges with tolerance angle - single mesh

    code by Alessio Erioli

    froGH by Co-de-iT is licensed under a Creative Commons Attribution 4.0 International License.
    http://creativecommons.org/licenses/by/4.0/

    */

    InitComp();

    if (M == null) return;
    
    double num = A / 57.2958;

    ConcurrentBag<GH_Line> list = new ConcurrentBag<GH_Line>();
    ConcurrentBag<GH_Line> list2 = new ConcurrentBag<GH_Line>();


    M.Normals.ComputeNormals();
    Rhino.Geometry.Collections.MeshTopologyEdgeList topologyEdges = M.TopologyEdges;

    int num2 = topologyEdges.Count - 1;
    Parallel.For(0, topologyEdges.Count, i =>
      //for (int i = 0; i <= num2; i++)
      {
      int[] connectedFaces = topologyEdges.GetConnectedFaces(i);
      if (connectedFaces.Length < 2)
        list2.Add(new GH_Line(topologyEdges.EdgeLine(i)));

      if (connectedFaces.Length == 2)
      {
        Vector3f val2 = M.FaceNormals[connectedFaces[0]];
        Vector3f val3 = M.FaceNormals[connectedFaces[1]];
        double num3 = Vector3d.VectorAngle(new Vector3d((double) val2.X, (double) val2.Y, (double) val2.Z),
          new Vector3d((double) val3.X, (double) val3.Y, (double) val3.Z));
        if (num3 > num)
          list.Add(new GH_Line(topologyEdges.EdgeLine(i)));

      }
      });

    Ei = list;
    En = list2;
# ---------- f_mseea: C# additional code ----------
  private void InitComp(){
    Component.Name = "Mesh Extract Edges with tolerance angle";
    Component.NickName = "f_MsEEA";
    Component.Description = "Extract Mesh edges with specific angle tolerance.\n\nOptimized for a single mesh";
    Component.Params.Input[0].Name = "Mesh";
    Component.Params.Input[0].Description = "The Input Mesh to process";
    Component.Params.Input[1].Name = "Angle";
    Component.Params.Input[1].Description = "The Tolerance Angle";
    Component.Params.Output[0].Name = "Internal Edges";
    Component.Params.Output[0].Description = "Internal edges lines under tolerance";
    Component.Params.Output[1].Name = "Naked Edges";
    Component.Params.Output[1].Description = "Naked edges lines";
  }
# ---------- end f_mseea ----------

# ----
previewlw_2 = CustomPreviewLineweights(Geometry=flatten(f_mseea.Ei), Shader=ColourSwatch(SwatchColor=RGB(133, 133, 133)), Thickness="1", Absolute=False)

# ----
# scalar values: use normalized (0-1) values
number_slider_2 = Slider(15, range=10..20)
vector_field = ValueList({"from curve": 0, "benchmark": 1}, selected="benchmark")

# ---- group: generate empty field from sample box
c_script = CSharpScript(B=box, res=number_slider_2, Reference="C:\Users\Alessio\AppData\Roaming\Grasshopper\Libraries\Assemblage.dll")  # -> out, F, P; inputs B: Box, res: Double
# ---------- c_script: C# usings ----------
using System.Linq;
using Assemblage;
# ---------- c_script: C# ----------
    if (!B.IsValid) return;

    double defRes = B.BoundingBox.Diagonal.X / 10.0;
    if (res == 0) res = defRes;

    Field f = new Field(B, res);
    F = f;
    P = f.GetGH_Points();
# ---------- end c_script ----------

# ---- group: generate a benchmark vector field (horizontal/vertical)
pdecon = Deconstruct(Point=c_script.P)  # -> XComponent, YComponent, ZComponent
smaller = SmallerThan(FirstNumber=pdecon.XComponent, SecondNumber=Slider(110, range=0..200))  # -> SmallerThan, OrEqualTo
Z = UnitZ(Factor=1)
X = UnitX(Factor=1)
weave = Weave(Pattern=graft(smaller.SmallerThan), Stream0=Z, Stream1=X, NullGaps=False)  # -> flatten(Weave)

# ---- group: scalar values from curve
crv_cp = CurveClosestPoint(Point=c_script.P, Curve=crv)  # -> Point, Parameter, Distance
bnd = Bounds(Numbers=crv_cp.Distance)
remap = RemapNumbers(Value=crv_cp.Distance, Source=bnd, Target=Domain(0, 1))  # -> Mapped, Clipped
graph = GraphMapper(
    remap.Mapped,
    x0=0,
    x1=1,
    y0=0,
    y1=1,
    container_name="Bezier",
    cpx=[0, 0.006395865232, 0.3728814721, 1],
    cpy=[0, 0.6423888206, 0.8989292979, 1])

# ---- group: vector field from curve
eval = EvaluateCurve(Curve=crv, Parameter=crv_cp.Parameter)  # -> Point, Tangent, Angle

# ----
filter = StreamFilter(Gate=vector_field, Stream0=eval.Tangent, Stream1=weave)
gradient = Gradient(LowerLimit=0, UpperLimit=1, Parameter=graph, stops=[0: RGB(255, 255, 255), 1: RGB(0, 0, 0)])

# ---- group: populate field
c_script_2 = CSharpScript(
    F=c_script.F,
    scalar=graph,
    vector=filter,
    Reference="C:\Users\Alessio\AppData\Roaming\Grasshopper\Libraries\Assemblage.dll")  # -> out, Fout, P, Fs, Fv; inputs scalar: list, vector: list
# ---------- c_script_2: C# ----------
    Field fi = (Field) F;
    List<double> scal = scalar.Select(s => (double) s).ToList();
    List<Vector3d> vec = vector.Select(v => (Vector3d) v).ToList();
    if (!fi.PopulateScalar(scal)) return;
    if (!fi.PopulateVector(vec)) return;
    Fout = fi;
    P = fi.GetPoints();
    Fs = fi.scalar;
    Fv = fi.vector;
# ---------- c_script_2: C# additional code ----------
  //  public class Field
  //  {
  //    public Point3d[] points;
  //    public double[] scalar;
  //    public Vector3d[] vector;
  //    Rhino.Collections.Point3dList ptsList;
  //
  //    public Field(Point3d[] points, double[] scalar, Vector3d[] vector)
  //    {
  //      this.points = points;
  //      this.scalar = scalar;
  //      this.vector = vector;
  //
  //      PopulatePtsList();
  //    }
  //
  //    // constructs an empty field
  //    public Field(Box b, double resX, double resY, double resZ)
  //    {
  //      Vector3d diag = b.BoundingBox.Diagonal;
  //      Point3d O = b.BoundingBox.Center - diag * 0.5;
  //
  //      int nX = (int) (diag.X / resX);
  //      int nY = (int) (diag.Y / resY);
  //      int nZ = (int) (diag.Z / resZ);
  //
  //      ptsList = new Rhino.Collections.Point3dList();
  //
  //      for (int i = 0; i < nX; i++)
  //        for (int j = 0; j < nY; j++)
  //          for (int k = 0; k < nZ; k++)
  //            ptsList.Add(new Point3d(O.X + (i + 0.5) * resX, O.Y + (j + 0.5) * resY, O.Z + (k + 0.5) * resZ));
  //    }
  //
  //    public Field(Box b, double res) : this(b, res, res, res)
  //    { }
  //
  //    private void PopulatePtsList()
  //    {
  //      ptsList = new Rhino.Collections.Point3dList();
  //      ptsList.AddRange(this.points);
  //    }
  //
  //    public double GetClosestScalar(Point3d P)
  //    {
  //      return scalar[ptsList.ClosestIndex(P)];
  //    }
  //
  //    public Vector3d GetClosestVector(Point3d P)
  //    {
  //      return vector[ptsList.ClosestIndex(P)];
  //    }
  //
  //    public GH_Point[] GetPoints()
  //    {
  //      return ptsList.Select(p => new GH_Point(p)).ToArray();
  //    }
  //
  //  }
# ---------- end c_script_2 ----------

# ----
amp = Amplitude(Vector=c_script_2.Fv, Amplitude=Slider(5, range=1..5))
preview = CustomPreview(Geometry=c_script_2.P, Material=gradient)  # disabled
vdisex = VectorDisplayEx(Point=c_script_2.P, Vector=amp, Colour=c_script_2.Fv, Width=2)

# ---- group: visualize values
tag = TextTag3D(Location=c_script.P, Text=c_script_2.Fs, Size=1, Justification=7)  # disabled
