# Grasshopper definition 05 - Load & Save.gh (Grasshopper 1.0.7)
# Copyright: Co-de-iT
# plug-ins: Human

# ---- group: receiving handles rotation
# Rhino reference file: collision test dummies.3dm
panel = Panel("""0
180""")
panel_2 = Panel("""0
90
180""")

# ----
panel_3 = Panel("""0
90
180""")
entwine = Entwine(Branch00=panel_3, Branch01=panel_3, Branch02=panel_3, Branch03=panel_3, FlattenInputs=True)  # -> simplify(Result)
panel_4 = Panel("""1.0
1.0
1.0
1.0""")
panel_5 = Panel("""1
1
1
1""")
crv = Curve([<curve referenced from the Rhino model> x4])
mesh = Mesh(<mesh referenced from the Rhino model>)
volume = Volume(Geometry=mesh)  # -> Volume, Centroid
Y = UnitY(Factor=1)
name = Panel("elle")
xy = XYPlane(Origin=volume.Centroid)

entwine_2 = Entwine(Branch00=panel, Branch01=panel_2, Branch02=panel, FlattenInputs=True)  # -> simplify(Result)
panel_6 = Panel("""1.0
1.0""")
panel_7 = Panel("""0
1
0""")
crv_2 = Curve([<curve referenced from the Rhino model> x3])

# ---- group: create handles
c_script = CSharpScript(
    poly=graft(crv_2),
    rot=entwine_2,
    type=graft(panel_7),
    w=graft(panel_6),
    Reference="C:\Users\Alessio\AppData\Roaming\Grasshopper\Libraries\Assemblage.dll")  # -> out, flatten(H); inputs poly: Polyline, rot: list of Double, type: Int32, w: Double
# ---------- c_script: C# usings ----------
using Assemblage;
using System.Drawing;
# ---------- c_script: C# ----------
    Handle hand;
    if (rot == null || rot.Count == 0)
    {
      List < double > rotats = new List<double> {0.0};
      hand = new Handle(poly, type, w, rotats);
    }
    else
      hand = new Handle(poly, type, w, rot);

    for(int i = 0; i < rot.Count; i++)
    {
      Line rX = new Line(hand.r[i].Origin, hand.r[i].Origin + (hand.r[i].XAxis * 1.2));
      _curve.Add(rX);
     _color.Add(Color.Blue);
    }
    H = hand;
# ---------- c_script: C# additional code ----------
  private BoundingBox _clip;
  private List<Line> _curve = new  List<Line>();
  private List<Color> _color = new  List<Color>();

  /// <summary>
  /// This method will be called once every solution, before any calls to RunScript.
  /// </summary>
  public override void BeforeRunScript()
  {
    _clip = BoundingBox.Empty;
    _curve.Clear();
    _color.Clear();
  }
  /// <summary>
  /// This method will be called once every solution, after any calls to RunScript.
  /// </summary>
  public override void AfterRunScript()
  { }


  //Return a BoundingBox that contains all the geometry you are about to draw.
  public override BoundingBox ClippingBox
  {
    get {  return _clip;}
  }

  //Draw all meshes in this method.
  public override void DrawViewportMeshes(IGH_PreviewArgs args)
  {
  }

  //Draw all wires and points in this method.
  public override void DrawViewportWires(IGH_PreviewArgs args)
  {
    for(int i = 0; i < _curve.Count; i++)
      args.Display.DrawDottedLine(_curve[i], _color[i]);
  }
# ---------- end c_script ----------

c_script_2 = CSharpScript(
    poly=graft(crv),
    rot=entwine,
    type=graft(panel_5),
    w=graft(panel_4),
    Reference="C:\Users\Alessio\AppData\Roaming\Grasshopper\Libraries\Assemblage.dll")  # -> out, flatten(H); inputs poly: Polyline, rot: list of Double, type: Int32, w: Double; same code as c_script

# ----
# © Co-de-iT 2020 / Creative Commons Attribution-Non Commercial-ShareAlike 4.0 International License
mesh_2 = Mesh(<mesh referenced from the Rhino model>)
volume_2 = Volume(Geometry=mesh_2)  # -> Volume, Centroid
X = UnitX(Factor=1)
# <title>
# 
# <description>
# 
# code by Alessio Erioli
# 
# v 0.1
name_2 = Panel("stick")
xy_2 = XYPlane(Origin=volume_2.Centroid)

# ---- group: create assembly object
c_script_3 = CSharpScript(
    M=mesh,
    name=name,
    id="1",
    weight="1.0",
    direction=Y,
    Plane=xy,
    H=c_script_2.H,
    Reference="C:\Users\Alessio\AppData\Roaming\Grasshopper\Libraries\Assemblage.dll")  # -> AO; inputs M: Mesh, name: String, id: Int32, weight: Double, direction: Vector3d, Plane: Plane, H: list
# ---------- c_script_3: C# usings ----------
using System.Linq;
using Assemblage;
# ---------- c_script_3: C# ----------
    Handle[] handles = H.Select(h => (Handle) h).ToArray();
    AO = new AssemblyObject(M, handles, name, id, Plane, direction, weight);
# ---------- end c_script_3 ----------

c_script_4 = CSharpScript(
    M=mesh_2,
    name=name_2,
    id="0",
    weight="1.0",
    direction=X,
    Plane=xy_2,
    H=c_script.H,
    Reference="C:\Users\Alessio\AppData\Roaming\Grasshopper\Libraries\Assemblage.dll")  # -> AO; inputs M: Mesh, name: String, id: Int32, weight: Double, direction: Vector3d, Plane: Plane, H: list; same code as c_script_3

# ----
merge = Merge(Data1=c_script_4, Data2=c_script_3)
subfolder = Panel("assemblages\")
f_ghfilepath = GHFilePathInfo()  # -> F, P
# ---------- f_ghfilepath: C# ----------
                                      /*
    froGH - a sparse collection of (in)utilities for Grasshopper

    GH File and Path info

    code by Alessio Erioli

    froGH by Co-de-iT is licensed under a Creative Commons Attribution 4.0 International License.
    http://creativecommons.org/licenses/by/4.0/

    */

    initComp();

    GH_Document ghDoc = Grasshopper.Instances.ActiveCanvas.Document;

    int nameLen = ghDoc.DisplayName.TrimEnd('*').Length + 3; // +3 accounts for the '.gh' extension
    int fileLen = ghDoc.FilePath.TrimEnd('*').Length;

    F = ghDoc.DisplayName.TrimEnd('*');
    P = ghDoc.FilePath.Substring(0, fileLen - nameLen);
# ---------- f_ghfilepath: C# additional code ----------
  void initComp(){

    Component.Name = "GH File Path Info";
    Component.NickName = "f_GHFilePath";
    Component.Description = "Provides info on current Grasshopper Document file name and path\nUseful for exporting files with the same name as the gh file and in the same directory";
    Component.Params.Output[0].Name = "File Name";
    Component.Params.Output[0].Description = "Current GH file name";
    Component.Params.Output[1].Name = "File Path";
    Component.Params.Output[1].Description = "Current GH file path";
  }
# ---------- end f_ghfilepath ----------
concat = Concatenate(FragmentA=f_ghfilepath.P, FragmentB=subfolder)
f_dirread = DirectoryReader(D=concat)  # -> F, Sd; inputs D: String
# ---------- f_dirread: C# usings ----------
using System.Linq;
using System.IO;
# ---------- f_dirread: C# ----------
                                      /*
    froGH - a sparse collection of (in)utilities for Grasshopper

    Directory Reader
    code by Alessio Erioli - value list generation based on code by James Ramsden

    froGH by Co-de-iT is licensed under a Creative Commons Attribution 4.0 International License.
    http://creativecommons.org/licenses/by/4.0/

    */

    InitComp();

    F = Directory.GetFiles(D).Select(s => s.Remove(0, D.Length)).ToList();
    Sd = Directory.GetDirectories(D).Select(s => s.Remove(0, D.Length)).ToList();
# ---------- f_dirread: C# additional code ----------
  private void InitComp()
  {
    Component.Name = "Directory Reader";
    Component.NickName = "f_DirRead";
    Component.Description = "Returns the list of Files and subdirectories in a Directory";
    Component.Params.Input[0].Name = "Directory path";
    Component.Params.Input[0].Description = "Path to the directory to read";
    Component.Params.Output[0].Name = "Flie list";
    Component.Params.Output[0].Description = "list of files in the directory";
    Component.Params.Output[1].Name = "Subdir list";
    Component.Params.Output[1].Description = "list of subdirs in the directory";
  }
# ---------- end f_dirread ----------
panel_8 = Panel(f_dirread.F)
item = ListItem(List=f_dirread.F, Index=Slider(1, range=0..10), Wrap=True)
panel_9 = Panel(item)
assemblage_output = Relay()
save = Button()
load = Button()
concat_2 = Concatenate(FragmentA=concat, FragmentB=item)

# ---- group: save assemblage to file
c_script_5 = CSharpScript(
    AOa=assemblage_output,
    path=concat,
    name="20200627",
    save=save,
    Reference="C:\Users\Alessio\AppData\Roaming\Grasshopper\Libraries\Assemblage.dll")  # -> info; inputs AOa: list, path: String, name: String, save: Boolean
# ---------- c_script_5: C# usings ----------
using System.Linq;
using Rhino.Geometry.Intersect;
using System.Threading.Tasks;
using Assemblage;
# ---------- c_script_5: C# ----------
        if (AOa == null) return;
        // cast input to AssemblyObject type
        AssemblyObject[] assemblage = AOa.Select(ao => (AssemblyObject)ao).ToArray();

        string[] s = AssemblageToString(assemblage);

        // add sequential placeholder to filename
        name += "_{0}.txt";

        if (save)
        {
            // sanity checks
            // if there is no directory, create one
            if (!System.IO.Directory.Exists(path)) System.IO.Directory.CreateDirectory(path);

            // Assume index=0 for the first filename.
            string fileName = path + string.Format(name, 0.ToString("D3"));
            Print(fileName);
            // Try to increment the index until we find a name which doesn't exist yet.
            if (System.IO.File.Exists(fileName))
                for (int i = 1; i < int.MaxValue; i++)
                {
                    string localName = path + string.Format(name, i.ToString("D3"));
                    if (localName == fileName)
                        return;

                    if (!System.IO.File.Exists(localName))
                    {
                        fileName = localName;
                        break;
                    }
                }

            //String target = path + name;

            System.IO.File.WriteAllLines(fileName, s.ToArray());
            //System.IO.File.WriteAllText(fileName,s);
            info = "file saved as: " + fileName;
        }
        else
        {
            info = "press save button to save file";
            //info = s;
        }
# ---------- c_script_5: C# additional code ----------
 


    public string[] AssemblageToString(AssemblyObject[] AO)
    {
        // 0. name
        // 1. weight
        // 2. scalar
        // 3. direction
        // 4. handle occupancy = neighbourhandle % handle weight
        // 5. ReferencePlane (OXY, sep. |)
        string[] s = new string[AO.Length];
        int i = 0;
        foreach (AssemblyObject ao in AO)
        {
            s[i] = "";
            s[i] += ao.name + ";";
            //s[i] += ao.id + ";";
            s[i] += ao.weight + ";";
            s[i] += ao.scalar + ";";
            s[i] += ao.direction.ToString() + ";";

            for (int j = 0; j < ao.handles.Length; j++)
            {
                s[i] += ao.handles[j].occupancy + "=";
                s[i] += ao.handles[j].neighbourHandle + "%";
                s[i] += ao.handles[j].weight;
                if (j < ao.handles.Length - 1) s[i] += ",";
            }
            s[i] += ";";
            s[i] += ao.referencePlane.Origin.ToString() + "|";
            s[i] += ao.referencePlane.XAxis.ToString() + "|";
            s[i] += ao.referencePlane.YAxis.ToString();
            i++;
        }

        return s;
    }
# ---------- end c_script_5 ----------

# ---- group: load assemblage from file
c_script_6 = CSharpScript(AOs=merge, Path=concat_2, load=load, Reference="C:\Users\Alessio\AppData\Roaming\Grasshopper\Libraries\Assemblage.dll")  # -> out, AOa, AOt; inputs AOs: list, Path: String, load: Boolean
# ---------- c_script_6: C# usings ----------
using System.Linq;
using Rhino.Geometry.Intersect;
using System.Threading.Tasks;
using Assemblage;
using System.Windows.Forms.VisualStyles;
# ---------- c_script_6: C# ----------
        if (Path == "" || Path == null) return;

        if (!System.IO.File.Exists(Path))
            throw new Exception("File not found");

        if (AOs == null) return;
        // cast input to AssemblyObject type
        AssemblyObject[] objectCatalog = AOs.Select(ao => (AssemblyObject)ao).ToArray();
        catalog = BuildCatalog(objectCatalog);

        if (load)
            assemblage = AssemblageFromFile(Path, objectCatalog, catalog);

        //OS = readFileByLines(Path);
        AOa = assemblage;
        AOt = ExtractTopology();
# ---------- c_script_6: C# additional code ----------
 

    public List<AssemblyObject> assemblage = new List<AssemblyObject>();
    public Dictionary<string, int> catalog;

    public Dictionary<string, int> BuildCatalog(AssemblyObject[] components)
    {
        Dictionary<string, int> cat = new Dictionary<string, int>();

        foreach (AssemblyObject ao in components)
            cat.Add(ao.name, ao.id);

        return cat;
    }

    public List<AssemblyObject> AssemblageFromFile(string path, AssemblyObject[] objectCatalog, Dictionary<string, int> catalog)
    {
        List<AssemblyObject> assemblage = new List<AssemblyObject>();

        string[][] obj = System.IO.File.ReadAllLines(path).Select(s => s.Split(new[] { ';' })).ToArray();

        for (int i = 0; i < obj.Length; i++)
        {
            // 0. name
            // 1. weight
            // 2. scalar
            // 3. direction
            // 4. handle occupancy = neighbourhandle % handle weight
            // 5. ReferencePlane (OXY, sep. |)

            // 0. name
            // if an object is not in the catalog, skip it
            if (!catalog.ContainsKey(obj[i][0]))
            {
                assemblage.Add(null);
                continue;
            }
            AssemblyObject aObj = new AssemblyObject(objectCatalog[catalog[obj[i][0]]]);
            // 1. weight
            aObj.weight = Convert.ToDouble(obj[i][1]);
            // 2. scalar
            aObj.scalar = Convert.ToDouble(obj[i][2]);
            // 3. direction
            double[] dir = obj[i][3].Split(new[] { ',' }).Select(x => Convert.ToDouble(x)).ToArray();
            Vector3d vDir = new Vector3d(dir[0], dir[1], dir[2]);
            aObj.direction = vDir;
            // 4. handle occupancy = neighbourhandle % handle weight
            string[][] handles = obj[i][4].Split(new[] { ',' }).Select(s => s.Split(new[] { '=', '%' })).ToArray();
            for (int j = 0; j < handles.Length; j++)
            {
                aObj.handles[j].occupancy = Convert.ToInt32(handles[j][0]);
                aObj.handles[j].neighbourHandle = Convert.ToInt32(handles[j][1]);
                aObj.handles[j].weight = Convert.ToDouble(handles[j][2]);
            }
            // 5. ReferencePlane (OXY, sep. |)
            string[][] rPlane = obj[i][5].Split(new[] { '|' }).Select(s => s.Split(new[] { ',' })).ToArray();
            Point3d O = new Point3d(Convert.ToDouble(rPlane[0][0]), Convert.ToDouble(rPlane[0][1]), Convert.ToDouble(rPlane[0][2]));
            Vector3d X = new Vector3d(Convert.ToDouble(rPlane[1][0]), Convert.ToDouble(rPlane[1][1]), Convert.ToDouble(rPlane[1][2]));
            Vector3d Y = new Vector3d(Convert.ToDouble(rPlane[2][0]), Convert.ToDouble(rPlane[2][1]), Convert.ToDouble(rPlane[2][2]));
            Plane rP = new Plane(O,X,Y);
            Transform orient = Transform.PlaneToPlane(aObj.referencePlane, rP);
            aObj.Transform(orient);
            assemblage.Add(aObj);
        }

        return assemblage;
    }

    public DataTree<string> ExtractTopology()
    {
        DataTree<string> topology = new DataTree<string>();

        string s;
        for (int i = 0; i < assemblage.Count; i++)
        {

            foreach (Handle h in assemblage[i].handles)
            {
                if (h.occupancy != -1 && h.occupancy != -2)
                {
                    //                                 nCindex   =       nCtype            |     nChandle
                    s = string.Format("{0}={1}|{2}", h.occupancy, assemblage[h.occupancy].id, h.neighbourHandle);
                }
                else
                {
                    s = h.occupancy.ToString();
                }
                topology.Add(s, new GH_Path(i));
            }
        }

        return topology;
    }

    public string readFileUnique(string path)
    {
        return System.IO.File.ReadAllText(path);
    }

    public string[] readFileByLines(string path)
    {
        return System.IO.File.ReadAllLines(path);
    }
# ---------- end c_script_6 ----------

# ----
panel_10 = Panel(c_script_5)

# ---- group: extract coarse geometry (meshes)
c_script_7 = CSharpScript(AO=c_script_6.AOa, Reference="C:\Users\Alessio\AppData\Roaming\Grasshopper\Libraries\Assemblage.dll")  # -> M
# ---------- c_script_7: C# usings ----------
using Assemblage;
# ---------- c_script_7: C# ----------
    if (AO == null) return;
    AssemblyObject o = (AssemblyObject) AO;

    M = o.coarseMesh;
# ---------- end c_script_7 ----------

# ----
f_mmeea = MeshesExtractEdgesWithToleranceAngle(M=c_script_7, A=45)  # -> flatten(Ei), En; inputs M: list of Mesh, A: Double
# ---------- f_mmeea: C# usings ----------
using System.Threading.Tasks;
using System.Collections.Concurrent;
using System.Linq;
# ---------- f_mmeea: C# ----------
          /*
    froGH - a sparse collection of (in)utilities for Grasshopper

    Mesh Extract Edges with tolerance angle - many meshes

    code by Alessio Erioli

    froGH by Co-de-iT is licensed under a Creative Commons Attribution 4.0 International License.
    http://creativecommons.org/licenses/by/4.0/

    */

    InitComp();

    if (M == null) return;

    double num = A / 57.2958;

    ConcurrentBag<GH_Line> list = new ConcurrentBag<GH_Line>();
    ConcurrentBag<GH_Line> list2 = new ConcurrentBag<GH_Line>();


    Parallel.ForEach(M, m =>
      {
      m.Normals.ComputeNormals();
      Rhino.Geometry.Collections.MeshTopologyEdgeList topologyEdges = m.TopologyEdges;
      int num2 = topologyEdges.Count - 1;
      for (int i = 0; i <= num2; i++)
      {
        int[] connectedFaces = topologyEdges.GetConnectedFaces(i);
        if (connectedFaces.Length < 2)
          list2.Add(new GH_Line(topologyEdges.EdgeLine(i)));

        if (connectedFaces.Length == 2)
        {
          Vector3f val2 = m.FaceNormals[connectedFaces[0]];
          Vector3f val3 = m.FaceNormals[connectedFaces[1]];
          double num3 = Vector3d.VectorAngle(new Vector3d((double) val2.X, (double) val2.Y, (double) val2.Z),
            new Vector3d((double) val3.X, (double) val3.Y, (double) val3.Z));
          if (num3 > num)
            list.Add(new GH_Line(topologyEdges.EdgeLine(i)));

        }
      }
      });

    Ei = list;
    En = list2;
# ---------- f_mmeea: C# additional code ----------
  private void InitComp(){
    Component.Name = "Meshes Extract Edges with tolerance angle";
    Component.NickName = "f_MmEEA";
    Component.Description = "Extract Mesh edges with specific angle tolerance.\n\nOptimized for many meshes";
    Component.Params.Input[0].Name = "Meshes";
    Component.Params.Input[0].Description = "The List of Input Meshes to process";
    Component.Params.Input[1].Name = "Angle";
    Component.Params.Input[1].Description = "The Tolerance Angle";
    Component.Params.Output[0].Name = "Internal Edges";
    Component.Params.Output[0].Description = "Internal edges lines under tolerance";
    Component.Params.Output[1].Name = "Naked Edges";
    Component.Params.Output[1].Description = "Naked edges lines";
  }
# ---------- end f_mmeea ----------
previewlw = CustomPreviewLineweights(Geometry=flatten(f_mmeea.Ei), Shader=ColourSwatch(SwatchColor=RGB(51, 51, 51)), Thickness="1", Absolute=False)
preview = CustomPreview(Geometry=c_script_7, Material=ColourSwatch(SwatchColor=RGB(133, 133, 133)))
