# Grasshopper definition 03-2 - topology operations_enhanced 2.gh (Grasshopper 1.0.7)
# Copyright: Co-de-iT
# plug-ins: Human

# ---- group: receiving handles rotation
# Rhino reference file: collision test dummies ENHANCED.3dm
panel = Panel("""0
180""")
panel_2 = Panel("""0
90
180""")

# ----
panel_3 = Panel("""0
90
180""")
entwine = Entwine(Branch00=panel, Branch01=panel_2, Branch02=panel, FlattenInputs=True)  # -> simplify(Result)
entwine_2 = Entwine(Branch00=panel_3, Branch01=panel_3, Branch02=panel_3, Branch03=panel_3, FlattenInputs=True)  # -> simplify(Result)
panel_4 = Panel("""1.0
1.0
1.0
1.0""")
panel_5 = Panel("""0
1
1
0""")
crv = Curve([<curve referenced from the Rhino model> x4])
panel_6 = Panel("""1.0
1.0
1.0
1.0""")
panel_7 = Panel("""1
1
1
1""")
crv_2 = Curve([<curve referenced from the Rhino model> x4])

# ---- group: create handles
c_script = CSharpScript(
    poly=graft(crv),
    rot=entwine,
    type=graft(panel_5),
    w=graft(panel_4),
    Reference="C:\Users\Alessio\AppData\Roaming\Grasshopper\Libraries\Assemblage.dll")  # -> out, flatten(H); inputs poly: Polyline, rot: list of Double, type: Int32, w: Double
# ---------- c_script: C# usings ----------
using Assemblage;
using System.Drawing;
# ---------- c_script: C# ----------
    Handle hand;
    if (rot == null || rot.Count == 0)
    {
      List < double > rotats = new List<double> {0.0};
      hand = new Handle(poly, type, w, rotats);
    }
    else
      hand = new Handle(poly, type, w, rot);

    for(int i = 0; i < rot.Count; i++)
    {
      Line rX = new Line(hand.r[i].Origin, hand.r[i].Origin + (hand.r[i].XAxis * 1.2));
      _curve.Add(rX);
     _color.Add(Color.Blue);
    }
    H = hand;
# ---------- c_script: C# additional code ----------
  private BoundingBox _clip;
  private List<Line> _curve = new  List<Line>();
  private List<Color> _color = new  List<Color>();

  /// <summary>
  /// This method will be called once every solution, before any calls to RunScript.
  /// </summary>
  public override void BeforeRunScript()
  {
    _clip = BoundingBox.Empty;
    _curve.Clear();
    _color.Clear();
  }
  /// <summary>
  /// This method will be called once every solution, after any calls to RunScript.
  /// </summary>
  public override void AfterRunScript()
  { }


  //Return a BoundingBox that contains all the geometry you are about to draw.
  public override BoundingBox ClippingBox
  {
    get {  return _clip;}
  }

  //Draw all meshes in this method.
  public override void DrawViewportMeshes(IGH_PreviewArgs args)
  {
  }

  //Draw all wires and points in this method.
  public override void DrawViewportWires(IGH_PreviewArgs args)
  {
    for(int i = 0; i < _curve.Count; i++)
      args.Display.DrawDottedLine(_curve[i], _color[i]);
  }
# ---------- end c_script ----------

c_script_2 = CSharpScript(
    poly=graft(crv_2),
    rot=entwine_2,
    type=graft(panel_7),
    w=graft(panel_6),
    Reference="C:\Users\Alessio\AppData\Roaming\Grasshopper\Libraries\Assemblage.dll")  # -> out, flatten(H); inputs poly: Polyline, rot: list of Double, type: Int32, w: Double; same code as c_script

# ----
# © Co-de-iT 2020 / Creative Commons Attribution-Non Commercial-ShareAlike 4.0 International License
mesh = Mesh(<mesh referenced from the Rhino model>)
mesh_2 = Mesh(<mesh referenced from the Rhino model>)
volume = Volume(Geometry=mesh)  # -> Volume, Centroid
X = UnitX(Factor=1)
volume_2 = Volume(Geometry=mesh_2)  # -> Volume, Centroid
Y = UnitY(Factor=1)
# <title>
# 
# <description>
# 
# code by Alessio Erioli
# 
# v 0.1
name = Panel("stick")
xy = XYPlane(Origin=volume.Centroid)
name_2 = Panel("elle")
xy_2 = XYPlane(Origin=volume_2.Centroid)

# ---- group: extra geometry / circulation curves optional
crv_3 = Curve(<curve referenced from the Rhino model>)

# ---- group: extra geometry / circulation curves
crv_4 = Curve([<curve referenced from the Rhino model> x4])

crv_5 = Curve([<curve referenced from the Rhino model> x4])

# ---- group: create assembly object
c_script_3 = CSharpScript(
    M=mesh,
    name=name,
    id="0",
    weight="1.0",
    direction=X,
    Plane=xy,
    H=c_script.H,
    Reference="C:\Users\Alessio\AppData\Roaming\Grasshopper\Libraries\Assemblage.dll")  # -> AO; inputs M: Mesh, name: String, id: Int32, weight: Double, direction: Vector3d, Plane: Plane, H: list
# ---------- c_script_3: C# usings ----------
using System.Linq;
using Assemblage;
# ---------- c_script_3: C# ----------
    Handle[] handles = H.Select(h => (Handle) h).ToArray();
    AO = new AssemblyObject(M, handles, name, id, Plane, direction, weight);
# ---------- end c_script_3 ----------

c_script_4 = CSharpScript(
    M=mesh_2,
    name=name_2,
    id="1",
    weight="1.0",
    direction=Y,
    Plane=xy_2,
    H=c_script_2.H,
    Reference="C:\Users\Alessio\AppData\Roaming\Grasshopper\Libraries\Assemblage.dll")  # -> AO; inputs M: Mesh, name: String, id: Int32, weight: Double, direction: Vector3d, Plane: Plane, H: list; same code as c_script_3

# ---- group: extra geometry
group = Group(Objects=crv_5)

group_2 = Group(Objects=[crv_4, crv_3])

# ----
merge = Merge(Data1=c_script_3, Data2=c_script_4)

# ---- group: load assemblage
f_ghfilepath = GHFilePathInfo()  # -> F, P
# ---------- f_ghfilepath: C# ----------
                                      /*
    froGH - a sparse collection of (in)utilities for Grasshopper

    GH File and Path info

    code by Alessio Erioli

    froGH by Co-de-iT is licensed under a Creative Commons Attribution 4.0 International License.
    http://creativecommons.org/licenses/by/4.0/

    */

    initComp();

    GH_Document ghDoc = Grasshopper.Instances.ActiveCanvas.Document;

    int nameLen = ghDoc.DisplayName.TrimEnd('*').Length + 3; // +3 accounts for the '.gh' extension
    int fileLen = ghDoc.FilePath.TrimEnd('*').Length;

    F = ghDoc.DisplayName.TrimEnd('*');
    P = ghDoc.FilePath.Substring(0, fileLen - nameLen);
# ---------- f_ghfilepath: C# additional code ----------
  void initComp(){

    Component.Name = "GH File Path Info";
    Component.NickName = "f_GHFilePath";
    Component.Description = "Provides info on current Grasshopper Document file name and path\nUseful for exporting files with the same name as the gh file and in the same directory";
    Component.Params.Output[0].Name = "File Name";
    Component.Params.Output[0].Description = "Current GH file name";
    Component.Params.Output[1].Name = "File Path";
    Component.Params.Output[1].Description = "Current GH file path";
  }
# ---------- end f_ghfilepath ----------
concat = Concatenate(FragmentA=f_ghfilepath.P, FragmentB="assemblages\")
f_dirread = DirectoryReader(D=concat)  # -> F, Sd; inputs D: String
# ---------- f_dirread: C# usings ----------
using System.Linq;
using System.IO;
# ---------- f_dirread: C# ----------
                                  /*
    froGH - a sparse collection of (in)utilities for Grasshopper

    Directory Reader
    code by Alessio Erioli - value list generation based on code by James Ramsden

    froGH by Co-de-iT is licensed under a Creative Commons Attribution 4.0 International License.
    http://creativecommons.org/licenses/by/4.0/

    */
   
    InitComp();

    F = Directory.GetFiles(D).Select(s => s.Remove(0, D.Length)).ToList();
    Sd = Directory.GetDirectories(D).Select(s => s.Remove(0, D.Length)).ToList();
# ---------- f_dirread: C# additional code ----------
  private void InitComp()
  {
    Component.Name = "Directory Reader";
    Component.NickName = "f_DirRead";
    Component.Description = "Returns the list of Files and subdirectories in a Directory";
    Component.Params.Input[0].Name = "Directory path";
    Component.Params.Input[0].Description = "Path to the directory to read";
    Component.Params.Output[0].Name = "Flie list";
    Component.Params.Output[0].Description = "list of files in the directory";
    Component.Params.Output[1].Name = "Subdir list";
    Component.Params.Output[1].Description = "list of subdirs in the directory";
  }
# ---------- end f_dirread ----------
panel_8 = Panel(f_dirread.F)
item = ListItem(List=panel_8, Index=Slider(0, range=0..5), Wrap=True)
concat_2 = Concatenate(FragmentA=concat, FragmentB=item)

# ----
load = Button()

# ---- group: load assemblage from file
c_script_5 = CSharpScript(AOs=merge, Path=concat_2, load=load, Reference="C:\Users\Alessio\AppData\Roaming\Grasshopper\Libraries\Assemblage.dll")  # -> out, AOa, AOt; inputs AOs: list, Path: String, load: Boolean
# ---------- c_script_5: C# usings ----------
using System.Linq;
using Rhino.Geometry.Intersect;
using System.Threading.Tasks;
using Assemblage;
using System.Windows.Forms.VisualStyles;
# ---------- c_script_5: C# ----------
        if (Path == "" || Path == null) return;

        if (!System.IO.File.Exists(Path))
            throw new Exception("File not found");

        if (AOs == null) return;
        // cast input to AssemblyObject type
        AssemblyObject[] objectCatalog = AOs.Select(ao => (AssemblyObject)ao).ToArray();
        catalog = BuildCatalog(objectCatalog);

        if (load)
            assemblage = AssemblageFromFile(Path, objectCatalog, catalog);

        //OS = readFileByLines(Path);
        AOa = assemblage;
        AOt = ExtractTopology();
# ---------- c_script_5: C# additional code ----------
 

    public List<AssemblyObject> assemblage = new List<AssemblyObject>();
    public Dictionary<string, int> catalog;

    public Dictionary<string, int> BuildCatalog(AssemblyObject[] components)
    {
        Dictionary<string, int> cat = new Dictionary<string, int>();

        foreach (AssemblyObject ao in components)
            cat.Add(ao.name, ao.id);

        return cat;
    }

    public List<AssemblyObject> AssemblageFromFile(string path, AssemblyObject[] objectCatalog, Dictionary<string, int> catalog)
    {
        List<AssemblyObject> assemblage = new List<AssemblyObject>();

        string[][] obj = System.IO.File.ReadAllLines(path).Select(s => s.Split(new[] { ';' })).ToArray();

        for (int i = 0; i < obj.Length; i++)
        {
            // 0. name
            // 1. weight
            // 2. scalar
            // 3. direction
            // 4. handle occupancy = neighbourhandle % handle weight
            // 5. ReferencePlane (OXY, sep. |)

            // 0. name
            // if an object is not in the catalog, skip it
            if (!catalog.ContainsKey(obj[i][0]))
            {
                assemblage.Add(null);
                continue;
            }
            AssemblyObject aObj = new AssemblyObject(objectCatalog[catalog[obj[i][0]]]);
            // 1. weight
            aObj.weight = Convert.ToDouble(obj[i][1]);
            // 2. scalar
            aObj.scalar = Convert.ToDouble(obj[i][2]);
            // 3. direction
            double[] dir = obj[i][3].Split(new[] { ',' }).Select(x => Convert.ToDouble(x)).ToArray();
            Vector3d vDir = new Vector3d(dir[0], dir[1], dir[2]);
            aObj.direction = vDir;
            // 4. handle occupancy = neighbourhandle % handle weight
            string[][] handles = obj[i][4].Split(new[] { ',' }).Select(s => s.Split(new[] { '=', '%' })).ToArray();
            for (int j = 0; j < handles.Length; j++)
            {
                aObj.handles[j].occupancy = Convert.ToInt32(handles[j][0]);
                aObj.handles[j].neighbourHandle = Convert.ToInt32(handles[j][1]);
                aObj.handles[j].weight = Convert.ToDouble(handles[j][2]);
            }
            // 5. ReferencePlane (OXY, sep. |)
            string[][] rPlane = obj[i][5].Split(new[] { '|' }).Select(s => s.Split(new[] { ',' })).ToArray();
            Point3d O = new Point3d(Convert.ToDouble(rPlane[0][0]), Convert.ToDouble(rPlane[0][1]), Convert.ToDouble(rPlane[0][2]));
            Vector3d X = new Vector3d(Convert.ToDouble(rPlane[1][0]), Convert.ToDouble(rPlane[1][1]), Convert.ToDouble(rPlane[1][2]));
            Vector3d Y = new Vector3d(Convert.ToDouble(rPlane[2][0]), Convert.ToDouble(rPlane[2][1]), Convert.ToDouble(rPlane[2][2]));
            Plane rP = new Plane(O,X,Y);
            Transform orient = Transform.PlaneToPlane(aObj.referencePlane, rP);
            aObj.Transform(orient);
            assemblage.Add(aObj);
        }

        return assemblage;
    }

    public DataTree<string> ExtractTopology()
    {
        DataTree<string> topology = new DataTree<string>();

        string s;
        for (int i = 0; i < assemblage.Count; i++)
        {

            foreach (Handle h in assemblage[i].handles)
            {
                if (h.occupancy != -1 && h.occupancy != -2)
                {
                    //                                 nCindex   =       nCtype            |     nChandle
                    s = string.Format("{0}={1}|{2}", h.occupancy, assemblage[h.occupancy].id, h.neighbourHandle);
                }
                else
                {
                    s = h.occupancy.ToString();
                }
                topology.Add(s, new GH_Path(i));
            }
        }

        return topology;
    }

    public string readFileUnique(string path)
    {
        return System.IO.File.ReadAllText(path);
    }

    public string[] readFileByLines(string path)
    {
        return System.IO.File.ReadAllLines(path);
    }
# ---------- end c_script_5 ----------

# ----
# topology map as tree:
# 
# . branch number is component index in assemblage
# 
# . list index is handle index
# 
# . string is:
# nCindex=nCtype|nChandle
# 
# (nC - neighbour component)
panel_9 = Panel("nCindex=nCtype|nChandle")

# ---- group: extract reference plane
c_script_6 = CSharpScript(AO=c_script_5.AOa, Reference="C:\Users\Alessio\AppData\Roaming\Grasshopper\Libraries\Assemblage.dll")  # -> P
# ---------- c_script_6: C# usings ----------
using Assemblage;
# ---------- c_script_6: C# ----------
    if (AO == null) return;
    AssemblyObject o = (AssemblyObject) AO;

    P = o.referencePlane;
# ---------- end c_script_6 ----------

# ---- group: extract object id
c_script_7 = CSharpScript(AO=c_script_5.AOa, Reference="C:\Users\Alessio\AppData\Roaming\Grasshopper\Libraries\Assemblage.dll")  # -> Id
# ---------- c_script_7: C# ----------
    if (AO == null) return;
    AssemblyObject o = (AssemblyObject) AO;

    Id = o.id;
# ---------- end c_script_7 ----------

# ---- group: extract coarse geometry (meshes)
c_script_8 = CSharpScript(AO=c_script_5.AOa, Reference="C:\Users\Alessio\AppData\Roaming\Grasshopper\Libraries\Assemblage.dll")  # -> M
# ---------- c_script_8: C# ----------
    if (AO == null) return;
    AssemblyObject o = (AssemblyObject) AO;

    M = o.coarseMesh;
# ---------- end c_script_8 ----------

# ---- group: Assemblage Topology
# nC - neighbour Component index
# 
# nT - neighbour component Type
# 
# nH - neighbour component handle
# (-1 free handle, -2 occluded handle)
c_script_9 = CSharpScript(AOt=c_script_5.AOt)  # -> out, nC, nT, nH; inputs AOt: tree of String
# ---------- c_script_9: C# ----------
    DataTree<int?> neighComp = new DataTree<int?>();
    DataTree<int?> neighType = new DataTree<int?>();
    DataTree<int> neighHand = new DataTree<int>();

    for(int i = 0; i < AOt.BranchCount; i++)
    {
      foreach(string s in AOt.Branches[i])
      {
        int[] data = s.Split(new [] {'|','='}).Select(x => Convert.ToInt32(x)).ToArray();

        if (data.Length == 3)
        {
          neighComp.Add(data[0], AOt.Paths[i]);
          neighType.Add(data[1], AOt.Paths[i]);
          neighHand.Add(data[2], AOt.Paths[i]);
        }else
        {
          neighComp.Add(null, AOt.Paths[i]);
          neighType.Add(null, AOt.Paths[i]);
          neighHand.Add(data[0], AOt.Paths[i]);
        }
      }

    }

    nC = neighComp;
    nT = neighType;
    nH = neighHand;
# ---------- end c_script_9 ----------

# ---- group: display
visualization_mode = ValueList({"objects": 0, "by occupancy": 1, "by type": 2, "by sequence": 3, "none": 4}, selected="none")
type_b = ColourSwatch(SwatchColor=RGB(80, 107, 110))
type_a = ColourSwatch(SwatchColor=RGB(176, 229, 232))
merge_2 = Merge(Data1=type_a, Data2=type_b)
cluster = Cluster(int=visualization_mode, mesh=c_script_8, int_2=c_script_9.nH, int_3=c_script_7, G=0, col=merge_2)

# ---- group: filtering optional circulation lines
sift = SiftPattern(List=c_script_6, SiftPattern=c_script_7)  # -> Output0, Output1
orient = Orient(Geometry=group_2, Source=xy_2, Target=sift.Output1)  # -> Geometry, Transform
orient_2 = Orient(Geometry=group, Source=xy, Target=sift.Output0)  # -> Geometry, Transform
ungroup = Ungroup(Group=orient.Geometry)
ungroup_2 = Ungroup(Group=orient_2.Geometry)
merge_3 = Merge(Data1=ungroup_2, Data2=ungroup)

# ---- group: display / display components
panel_10 = Panel("45")
mjoin = MeshJoin(Meshes=cluster)
preview = CustomPreview(
    Geometry=mjoin,
    Material={diffuse=RGB(221, 160, 221), emission=RGB(66, 48, 66), shine=0.5, specular=RGB(255, 255, 255), transparency=0})

# ---- group: display / display components / extract edges with angle tolerance (many meshes)
f_mmeea = MeshesExtractEdgesWithToleranceAngle(M=c_script_8, A=panel_10)  # -> flatten(Ei), En; inputs M: list of Mesh, A: Double
# ---------- f_mmeea: C# usings ----------
using System.Threading.Tasks;
using System.Collections.Concurrent;
using System.Linq;
# ---------- f_mmeea: C# ----------
          /*
    froGH - a sparse collection of (in)utilities for Grasshopper

    Mesh Extract Edges with tolerance angle - many meshes

    code by Alessio Erioli

    froGH by Co-de-iT is licensed under a Creative Commons Attribution 4.0 International License.
    http://creativecommons.org/licenses/by/4.0/

    */

    InitComp();

    if (M == null) return;

    double num = A / 57.2958;

    ConcurrentBag<GH_Line> list = new ConcurrentBag<GH_Line>();
    ConcurrentBag<GH_Line> list2 = new ConcurrentBag<GH_Line>();


    Parallel.ForEach(M, m =>
      {
      m.Normals.ComputeNormals();
      Rhino.Geometry.Collections.MeshTopologyEdgeList topologyEdges = m.TopologyEdges;
      int num2 = topologyEdges.Count - 1;
      for (int i = 0; i <= num2; i++)
      {
        int[] connectedFaces = topologyEdges.GetConnectedFaces(i);
        if (connectedFaces.Length < 2)
          list2.Add(new GH_Line(topologyEdges.EdgeLine(i)));

        if (connectedFaces.Length == 2)
        {
          Vector3f val2 = m.FaceNormals[connectedFaces[0]];
          Vector3f val3 = m.FaceNormals[connectedFaces[1]];
          double num3 = Vector3d.VectorAngle(new Vector3d((double) val2.X, (double) val2.Y, (double) val2.Z),
            new Vector3d((double) val3.X, (double) val3.Y, (double) val3.Z));
          if (num3 > num)
            list.Add(new GH_Line(topologyEdges.EdgeLine(i)));

        }
      }
      });

    Ei = list;
    En = list2;
# ---------- f_mmeea: C# additional code ----------
  private void InitComp(){
    Component.Name = "Meshes Extract Edges with tolerance angle";
    Component.NickName = "f_MmEEA";
    Component.Description = "Extract Mesh edges with specific angle tolerance.\n\nOptimized for many meshes";
    Component.Params.Input[0].Name = "Meshes";
    Component.Params.Input[0].Description = "The List of Input Meshes to process";
    Component.Params.Input[1].Name = "Angle";
    Component.Params.Input[1].Description = "The Tolerance Angle";
    Component.Params.Output[0].Name = "Internal Edges";
    Component.Params.Output[0].Description = "Internal edges lines under tolerance";
    Component.Params.Output[1].Name = "Naked Edges";
    Component.Params.Output[1].Description = "Naked edges lines";
  }
# ---------- end f_mmeea ----------

# ---- group: display / display components / display edges
previewlw = CustomPreviewLineweights(Geometry=f_mmeea.Ei, Shader=ColourSwatch(SwatchColor=RGB(0, 0, 0)), Thickness=Slider(1, range=1..3), Absolute=False)

# ----
line = Line(flatten(merge_3))

# ---- group: extract open circulation ends
approximation_digits = Panel("3")
f_tln = Topologizer(L=line, d=approximation_digits)  # -> P, LP, PP, PLD; inputs L: list of Line, d: Int32
# ---------- f_tln: C# ----------
                               /*
    froGH - a sparse collection of (in)utilities for Grasshopper

    Topologizer

    code by Alessio Erioli

    froGH by Co-de-iT is licensed under a Creative Commons Attribution 4.0 International License.
    http://creativecommons.org/licenses/by/4.0/

    */

    initComp();

    if(L == null || L.Count == 0) return;

    Line[] L1 = L.ToArray();
    List<Point3d> pts = new List<Point3d>();

    for (int i = 0; i < L1.Length; i++)
    {
      L1[i].FromX = Math.Round(L1[i].FromX, d);
      L1[i].FromY = Math.Round(L1[i].FromY, d);
      L1[i].FromZ = Math.Round(L1[i].FromZ, d);
      L1[i].ToX = Math.Round(L1[i].ToX, d);
      L1[i].ToY = Math.Round(L1[i].ToY, d);
      L1[i].ToZ = Math.Round(L1[i].ToZ, d);

      pts.Add(L1[i].From);
      pts.Add(L1[i].To);
    }

    // create the set of unique points
    HashSet<Point3d> points = new HashSet<Point3d>(pts/*, new Point3dComparer(doc.ModelAbsoluteTolerance)*/);

    List<Point3d> ptList = new List<Point3d>();
    ptList.AddRange(points);

    // output the set of unique points as list
    P = ptList;

    // create the Line-Points connectivity tree
    // each branch corresponds to a line and contains
    // the indexes of the connected points
    DataTree<int> LinePts = new DataTree<int>();
    int iS, iE;
    GH_Path p;
    for (int i = 0; i < L1.Length;i++)
    {
      p = new GH_Path(i);
      iS = ptList.IndexOf(L1[i].From);
      iE = ptList.IndexOf(L1[i].To);
      LinePts.Add(iS, p);
      LinePts.Add(iE, p);
    }

    LP = LinePts;

    // create the Point-Points connectivity tree (neighbours)
    DataTree<int> PtPts = new DataTree<int>();
    DataTree<int> PtLDir = new DataTree<int>();
    GH_Path pS, pE;
    for (int i = 0; i < LinePts.BranchCount; i++)
    {
      // adds the index of the start point to the branch of the end point and vice-versa
      pS = new GH_Path(LinePts.Branches[i][0]);
      pE = new GH_Path(LinePts.Branches[i][1]);
      PtPts.Add(LinePts.Branches[i][0], pE);
      PtLDir.Add(-1, pE);
      PtPts.Add(LinePts.Branches[i][1], pS);
      PtLDir.Add(1, pS);
    }

    PP = PtPts;
    PLD = PtLDir;
# ---------- f_tln: C# additional code ----------
  void initComp(){
    Component.Name = "Topologizer";
    Component.NickName = "f_TLN";
    Component.Description = "Solves line network topology";
    Component.Params.Input[0].Name = "Line network";
    Component.Params.Input[0].Description = "Network of lines, all connecting only at endpoints";
    Component.Params.Input[1].Name = "Decimals";
    Component.Params.Input[1].Description = "number of decimals for connectiuon tolerance (3 is usually ok)";
    Component.Params.Output[0].Name = "Points";
    Component.Params.Output[0].Description = "List of unique point nodes";
    Component.Params.Output[1].Name = "Line-Points Data";
    Component.Params.Output[1].Description = "Indexes of start and end point of each line";
    Component.Params.Output[2].Name = "Point Connectivity";
    Component.Params.Output[2].Description = "Indexes of connected points to each unique point";
    Component.Params.Output[3].Name = "Line Direction at each Point";
    Component.Params.Output[3].Description = "Direction of each line connected to a point (1 outward, -1 inward)";
  }
  
  public class Point3dComparer : IEqualityComparer<Point3d>
  {
    double m_tol;

    public Point3dComparer(double tol)
    {
      m_tol = tol;
    }
    public bool Equals(Point3d a, Point3d b)
    {
      //return a.EpsilonEquals(b, m_tol);
      //return (a.X - b.X) < m_tol && (a.Y - b.Y) < m_tol && (a.Z - b.Z) < m_tol;
      return nEqual(a.X, b.X, m_tol) && nEqual(a.Y, b.Y, m_tol) && nEqual(a.Z, b.Z, m_tol);

    }
    public int GetHashCode(Point3d pnt)
    {
      return (pnt.X.GetHashCode() ^ pnt.Y.GetHashCode() ^ pnt.Z.GetHashCode());
    }

    // see: https://floating-point-gui.de/errors/comparison/
    public static bool nEqual(double a, double b, double epsilon) {
      double absA = Math.Abs(a);
      double absB = Math.Abs(b);
      double diff = Math.Abs(a - b);

      if (a == b) { // shortcut, handles infinities
        return true;
      } else if (a == 0 || b == 0 || (absA + absB < Double.MinValue)) {
        // a or b is zero or both are extremely close to it
        // relative error is less meaningful here

        return diff < (epsilon * Double.MinValue);
      } else { // use relative error
        return diff / Math.Min((absA + absB), Double.MaxValue) < epsilon;
      }
    }
  }
# ---------- end f_tln ----------
f_tinv = TopologyInverter(Tt=f_tln.LP)  # -> Tti; inputs Tt: tree of Int32
# ---------- f_tinv: C# ----------
 
                           /*
    froGH - a sparse collection of (in)utilities for Grasshopper

    Topology inverter
    Invert topology tree indexes
    ex. in a network, from nodes sorted by lines to lines sorted by node and vice-versa

    code by Alessio Erioli

    froGH by Co-de-iT is licensed under a Creative Commons Attribution 4.0 International License.
    http://creativecommons.org/licenses/by/4.0/

    */

    initComp();


    DataTree<int> TInv = new DataTree<int>();

    for (int i = 0; i < Tt.BranchCount; i++)
      for(int j = 0; j < Tt.Branches[i].Count; j++)
        TInv.Add(Tt.Paths[i].Indices[0], new GH_Path(Tt.Branches[i][j]));

    Tti = TInv;
# ---------- f_tinv: C# additional code ----------
  void initComp(){
    Component.Name = "Topology Inverter";
    Component.NickName = "f_TInv";
    Component.Description = "Invert topology tree indexes\nex. in a network, from nodes sorted by lines\nto lines sorted by node and vice - versa";
    Component.Params.Input[0].Name = "Topology Tree";
    Component.Params.Input[0].Description = "Topological Data as Tree";
    Component.Params.Output[0].Name = "Inverse Topology";
    Component.Params.Output[0].Description = "Inverse Topological Data as Tree";
  }
# ---------- end f_tinv ----------

# ---- group: extremities points
viewer = ParamViewer(f_tln.PP)
lng = ListLength(List=f_tln.PP)
equals = Equality(FirstNumber=lng, SecondNumber="1")  # -> Equality, Inequality
dpath = DeconstructPath(Branch=viewer)  # -> simplify(Indices)
dispatch = Dispatch(List=dpath, DispatchPattern=equals.Equality)  # -> ListA, ListB
item_2 = ListItem(List=f_tln.P, Index=flatten(dispatch.ListA), Wrap=True)

# ----
lng_2 = ListLength(List=f_tinv)
equals_2 = Equality(FirstNumber=lng_2, SecondNumber="1")  # -> Equality, Inequality
dispatch_2 = Dispatch(List=f_tinv, DispatchPattern=equals_2.Equality)  # -> ListA, ListB
cset = CreateSet(List=flatten(dispatch_2.ListA))  # -> Set, Map

# ---- group: open lines
item_3 = ListItem(List=line, Index=flatten(cset.Set), Wrap=True)

# ---- group: connected lines
cull_i = CullIndex(List=line, Indices=cset.Set, Wrap=True)

# ----
preview_2 = CustomPreview(Geometry=item_2, Material=ColourSwatch(SwatchColor=RGB(74, 145, 124)))
previewlw_2 = CustomPreviewLineweights(Geometry=cull_i, Shader=ColourSwatch(SwatchColor=RGB(255, 255, 255)), Thickness="3", Absolute=False)
previewlw_3 = CustomPreviewLineweights(Geometry=item_3, Shader=ColourSwatch(SwatchColor=RGB(73, 143, 122)), Absolute=False)

# ==== cluster Cluster
int = ClusterInput()
mesh = ClusterInput()
int_2 = ClusterInput()
col = ClusterInput()
int_3 = ClusterInput()
int_4 = Integer(int)
mesh_2 = Mesh(mesh)
int_5 = Integer(int_2)
col_2 = Colour(col)
int_6 = Integer(int_3)
gate = StreamGate(Stream=mesh_2, Gate=int_4)  # -> Target0, Target1, Target2, Target3, Target4
equals = Equality(FirstNumber=int_5, SecondNumber="-1")  # -> Equality, Inequality
G = ClusterInput()
f_massbool = MassBoolean(V=equals.Equality, type=1)  # -> B; inputs V: list of Boolean, type: Int32
# ---------- f_massbool: C# ----------
  /*
    froGH - a sparse collection of (in)utilities for Grasshopper

    mass boolean
    code by Alessio Erioli

    froGH by Co-de-iT is licensed under a Creative Commons Attribution 4.0 International License.
    http://creativecommons.org/licenses/by/4.0/

    */
    initComp();

    bool r;
    if (type == 0) {
      Component.Message = "AND";
      r = true;
    }else{
      Component.Message = "OR";
      r = false;
    }


    for (int i = 0; i < V.Count; i++){
      if (type == 0) {
        r = r && V[i];
      }
      else{
        r = r || V[i];
      }
    }
    B = r;
# ---------- f_massbool: C# additional code ----------
  void initComp(){
    Component.Name = "Mass Boolean";
    Component.NickName = "f_MassBool";
    Component.Description = "Mass boolean operator on a list of values";
    Component.Params.Input[0].Name = "Values";
    Component.Params.Input[0].Description = "boolean values as list";
    Component.Params.Input[1].Name = "Boolean operator";
    Component.Params.Input[1].Description = "type of operator: 0 AND, 1 OR";
    Component.Params.Output[0].Name = "Boolean result";
    Component.Params.Output[0].Description = "the result";

  }
# ---------- end f_massbool ----------
filter = StreamFilter(Gate=G, Stream0=gate.Target3)

# ---- group: display by assemblage sequence
lng = ListLength(List=filter)  # -> expr("x-1", Length)
f_ifroml = IndexesFromList(D=filter)  # -> i; inputs D: list
# ---------- f_ifroml: C# usings ----------
using System.Linq;
# ---------- f_ifroml: C# ----------
   
 /*
    froGH - a sparse collection of (in)utilities for Grasshopper

    Indexes from Number
    code by Alessio Erioli

    froGH by Co-de-iT is licensed under a Creative Commons Attribution 4.0 International License.
    http://creativecommons.org/licenses/by/4.0/

    */
    initComp();
   
    GH_Integer[] indexes = new GH_Integer[D.Count];

    for(int j = 0; j < D.Count; j++)
      indexes[j] = new GH_Integer(j);

    //A = indexes.Sum(j => j.Value); // uses System.Linq Sum selector function - for each GH_Integer j in indexes add its value to the total sum

    i = indexes;
# ---------- f_ifroml: C# additional code ----------
  void initComp(){
    Component.Name = "Indexes from List";
    Component.NickName = "f_iFromL";
    Component.Description = "Generates a list of 0-based integer indexes from a given list of data";
    Component.Params.Input[0].Name = "Data";
    Component.Params.Input[0].Description = "the list to index";
    Component.Params.Output[0].Name = "Indexes";
    Component.Params.Output[0].Description = "the generated indexes";
  }
# ---------- end f_ifroml ----------
one_over_x = OneOverX(Value=lng)
multiplication = Multiplication(A=f_ifroml, B=one_over_x)
sqr = Square(Value=multiplication)
gradient = Gradient(
    LowerLimit=0,
    UpperLimit=1,
    Parameter=sqr,
    stops=[0: RGB(0, 0, 0), 0.498: RGB(56, 136, 150), 0.904: RGB(186, 224, 224), 1: RGB(255, 255, 255)])
mcol = MeshColours(Mesh=graft(filter), Colours=graft(gradient))  # -> flatten(Mesh)

# ---- group: occupied/available visualization
saturated = ColourSwatch(SwatchColor=RGB(194, 199, 137))
available = ColourSwatch(SwatchColor=RGB(255, 255, 255))
weave = Weave(Pattern=f_massbool, Stream0=saturated, Stream1=available, NullGaps=False)  # -> simplify(Weave)
mcol_2 = MeshColours(Mesh=graft(gate.Target1), Colours=weave)  # -> flatten(Mesh)

# ----
item = ListItem(List=col_2, Index=graft(int_6), Wrap=True)  # -> simplify(Item)

# ---- group: display by component type
mcol_3 = MeshColours(Mesh=graft(gate.Target2), Colours=item)  # -> flatten(Mesh)

# ----
mcol_4 = MeshColours(Mesh=gate.Target0, Colours=ColourSwatch(SwatchColor=RGB(255, 255, 255)))
filter_2 = StreamFilter(Gate=int_4, Stream0=mcol_4, Stream1=mcol_2, Stream2=mcol_3, Stream3=mcol)
mesh_3 = Mesh(filter_2)
mesh_4 = ClusterOutput(mesh_3)
