# Grasshopper definition 03 - post processing_blocks_enhanced.gh (Grasshopper 1.0.7)
# Copyright: Co-de-iT
# plug-ins: Human, Noise 4D, Impala

# NOTE: This definition requires the following additional plugins:
# 
# 4dNoise
# Impala
# 
# both can be downloaded at food4rhino.com
rhino_reference_file = Panel("blocks.3dm")
panel = Panel("""0
180""")
panel_2 = Panel("""0
180""")
crv = Curve(<curve referenced from the Rhino model>)
panel_3 = Panel("""0
90
180""")
crv_2 = Curve([<curve referenced from the Rhino model> x2])
crv_3 = Curve([<curve referenced from the Rhino model> x6])
panel_4 = Panel("""0
90
180""")
crv_4 = Curve([<curve referenced from the Rhino model> x6])
lng = ListLength(List=crv_3)
lng_2 = ListLength(List=crv_4)
dup = DuplicateData(Data="0", Number=lng, Order=True)
dup_2 = DuplicateData(Data="0", Number=lng_2, Order=True)
panel_5 = Panel("""1
1""")
merge = Merge(Data1=crv_3, Data2=crv)
merge_2 = Merge(Data1=crv_4, Data2=crv_2)
merge_3 = Merge(Data1=flatten(dup), Data2="1")
merge_4 = Merge(Data1=flatten(dup_2), Data2=panel_5)
entwine = Entwine(
    Branch00=panel_3,
    Branch01=panel_3,
    Branch02=panel_3,
    Branch03=panel_3,
    Branch04=panel_3,
    Branch05=panel_3,
    Branch06=panel,
    FlattenInputs=True)
entwine_2 = Entwine(
    Branch00=panel_4,
    Branch01=panel_4,
    Branch02=panel_4,
    Branch03=panel_4,
    Branch04=panel_4,
    Branch05=panel_4,
    Branch06=panel_2,
    Branch07=panel_2,
    FlattenInputs=True)

# ---- group: create handles
c_script = CSharpScript(
    poly=graft(merge),
    rot=entwine,
    type=graft(merge_3),
    w=graft("0"),
    Reference="C:\USERS\ALESS\APPDATA\ROAMING\GRASSHOPPER\LIBRARIES\Assemblage.dll")  # -> out, flatten(H); inputs poly: Polyline, rot: list of Double, type: Int32, w: Double
# ---------- c_script: C# usings ----------
using Assemblage;
using System.Drawing;
# ---------- c_script: C# ----------
    Handle hand;
    if (rot == null || rot.Count == 0)
    {
      List < double > rotats = new List<double> {0.0};
      hand = new Handle(poly, type, w, rotats);
    }
    else
      hand = new Handle(poly, type, w, rot);

    for(int i = 0; i < rot.Count; i++)
    {
      Line rX = new Line(hand.r[i].Origin, hand.r[i].Origin + (hand.r[i].XAxis * 1.2));
      _curve.Add(rX);
     _color.Add(Color.Blue);
    }
    H = hand;
# ---------- c_script: C# additional code ----------
  private BoundingBox _clip;
  private List<Line> _curve = new  List<Line>();
  private List<Color> _color = new  List<Color>();

  /// <summary>
  /// This method will be called once every solution, before any calls to RunScript.
  /// </summary>
  public override void BeforeRunScript()
  {
    _clip = BoundingBox.Empty;
    _curve.Clear();
    _color.Clear();
  }
  /// <summary>
  /// This method will be called once every solution, after any calls to RunScript.
  /// </summary>
  public override void AfterRunScript()
  { }


  //Return a BoundingBox that contains all the geometry you are about to draw.
  public override BoundingBox ClippingBox
  {
    get {  return _clip;}
  }

  //Draw all meshes in this method.
  public override void DrawViewportMeshes(IGH_PreviewArgs args)
  {
  }

  //Draw all wires and points in this method.
  public override void DrawViewportWires(IGH_PreviewArgs args)
  {
    for(int i = 0; i < _curve.Count; i++)
      args.Display.DrawDottedLine(_curve[i], _color[i]);
  }
# ---------- end c_script ----------

c_script_2 = CSharpScript(
    poly=graft(merge_2),
    rot=entwine_2,
    type=graft(merge_4),
    w=graft("0"),
    Reference="C:\USERS\ALESS\APPDATA\ROAMING\GRASSHOPPER\LIBRARIES\Assemblage.dll")  # -> out, flatten(H); inputs poly: Polyline, rot: list of Double, type: Int32, w: Double; same code as c_script

# ----
# © Co-de-iT 2020 / Creative Commons Attribution-Non Commercial-ShareAlike 4.0 International License
mesh = Mesh(<mesh referenced from the Rhino model>)
mesh_2 = Mesh(<mesh referenced from the Rhino model>)
volume = Volume(Geometry=mesh)  # -> Volume, Centroid
X = UnitX(Factor=1)
volume_2 = Volume(Geometry=mesh_2)  # -> Volume, Centroid
X_2 = UnitX(Factor=1)
# <title>
# 
# <description>
# 
# code by Alessio Erioli
# 
# v 0.1
name = Panel("block0")
name_2 = Panel("block1")
xy = XYPlane(Origin=volume.Centroid)
xy_2 = XYPlane(Origin=volume_2.Centroid)

# ---- group: create assembly object
c_script_3 = CSharpScript(
    M=mesh,
    name=name,
    id="0",
    weight="1.0",
    direction=X,
    Plane=xy,
    H=c_script.H,
    Reference="C:\USERS\ALESS\APPDATA\ROAMING\GRASSHOPPER\LIBRARIES\Assemblage.dll")  # -> AO; inputs M: Mesh, name: String, id: Int32, weight: Double, direction: Vector3d, Plane: Plane, H: list
# ---------- c_script_3: C# usings ----------
using System.Linq;
using Assemblage;
# ---------- c_script_3: C# ----------
    Handle[] handles = H.Select(h => (Handle) h).ToArray();
    AO = new AssemblyObject(M, handles, name, id, Plane, direction, weight);
# ---------- end c_script_3 ----------

c_script_4 = CSharpScript(
    M=mesh_2,
    name=name_2,
    id="1",
    weight="1.0",
    direction=X_2,
    Plane=xy_2,
    H=c_script_2.H,
    Reference="C:\USERS\ALESS\APPDATA\ROAMING\GRASSHOPPER\LIBRARIES\Assemblage.dll")  # -> AO; inputs M: Mesh, name: String, id: Int32, weight: Double, direction: Vector3d, Plane: Plane, H: list; same code as c_script_3

# ----
merge_5 = Merge(Data1=c_script_3, Data2=c_script_4)

# ---- group: load assemblage
f_ghfilepath = GHFilePathInfo()  # -> F, P
# ---------- f_ghfilepath: C# ----------
                                      /*
    froGH - a sparse collection of (in)utilities for Grasshopper

    GH File and Path info

    code by Alessio Erioli

    froGH by Co-de-iT is licensed under a Creative Commons Attribution 4.0 International License.
    http://creativecommons.org/licenses/by/4.0/

    */

    initComp();

    GH_Document ghDoc = Grasshopper.Instances.ActiveCanvas.Document;

    int nameLen = ghDoc.DisplayName.TrimEnd('*').Length + 3; // +3 accounts for the '.gh' extension
    int fileLen = ghDoc.FilePath.TrimEnd('*').Length;

    F = ghDoc.DisplayName.TrimEnd('*');
    P = ghDoc.FilePath.Substring(0, fileLen - nameLen);
# ---------- f_ghfilepath: C# additional code ----------
  void initComp(){

    Component.Name = "GH File Path Info";
    Component.NickName = "f_GHFilePath";
    Component.Description = "Provides info on current Grasshopper Document file name and path\nUseful for exporting files with the same name as the gh file and in the same directory";
    Component.Params.Output[0].Name = "File Name";
    Component.Params.Output[0].Description = "Current GH file name";
    Component.Params.Output[1].Name = "File Path";
    Component.Params.Output[1].Description = "Current GH file path";
  }
# ---------- end f_ghfilepath ----------
concat = Concatenate(FragmentA=f_ghfilepath.P, FragmentB="assemblages\")
f_dirread = DirectoryReader(D=concat)  # -> F, Sd; inputs D: String
# ---------- f_dirread: C# usings ----------
using System.Linq;
using System.IO;
# ---------- f_dirread: C# ----------
                                  /*
    froGH - a sparse collection of (in)utilities for Grasshopper

    Directory Reader
    code by Alessio Erioli - value list generation based on code by James Ramsden

    froGH by Co-de-iT is licensed under a Creative Commons Attribution 4.0 International License.
    http://creativecommons.org/licenses/by/4.0/

    */
   
    InitComp();

    F = Directory.GetFiles(D).Select(s => s.Remove(0, D.Length)).ToList();
    Sd = Directory.GetDirectories(D).Select(s => s.Remove(0, D.Length)).ToList();
# ---------- f_dirread: C# additional code ----------
  private void InitComp()
  {
    Component.Name = "Directory Reader";
    Component.NickName = "f_DirRead";
    Component.Description = "Returns the list of Files and subdirectories in a Directory";
    Component.Params.Input[0].Name = "Directory path";
    Component.Params.Input[0].Description = "Path to the directory to read";
    Component.Params.Output[0].Name = "Flie list";
    Component.Params.Output[0].Description = "list of files in the directory";
    Component.Params.Output[1].Name = "Subdir list";
    Component.Params.Output[1].Description = "list of subdirs in the directory";
  }
# ---------- end f_dirread ----------
panel_6 = Panel(f_dirread.F)
item = ListItem(List=panel_6, Index=Slider(2, range=0..5), Wrap=True)
concat_2 = Concatenate(FragmentA=concat, FragmentB=item)

# ----
load = Button()
panel_7 = Panel(item)

# ---- group: load assemblage from file
c_script_5 = CSharpScript(AOs=merge_5, Path=concat_2, load=load, Reference="C:\USERS\ALESS\APPDATA\ROAMING\GRASSHOPPER\LIBRARIES\Assemblage.dll")  # -> out, AOa, AOt; inputs AOs: list, Path: String, load: Boolean
# ---------- c_script_5: C# usings ----------
using System.Linq;
using Rhino.Geometry.Intersect;
using System.Threading.Tasks;
using Assemblage;
using System.Windows.Forms.VisualStyles;
# ---------- c_script_5: C# ----------
        if (Path == "" || Path == null) return;

        if (!System.IO.File.Exists(Path))
            throw new Exception("File not found");

        if (AOs == null) return;
        // cast input to AssemblyObject type
        AssemblyObject[] objectCatalog = AOs.Select(ao => (AssemblyObject)ao).ToArray();
        catalog = BuildCatalog(objectCatalog);

        if (load)
            assemblage = AssemblageFromFile(Path, objectCatalog, catalog);

        //OS = readFileByLines(Path);
        AOa = assemblage;
        AOt = ExtractTopology();
# ---------- c_script_5: C# additional code ----------
 

    public List<AssemblyObject> assemblage = new List<AssemblyObject>();
    public Dictionary<string, int> catalog;

    public Dictionary<string, int> BuildCatalog(AssemblyObject[] components)
    {
        Dictionary<string, int> cat = new Dictionary<string, int>();

        foreach (AssemblyObject ao in components)
            cat.Add(ao.name, ao.id);

        return cat;
    }

    public List<AssemblyObject> AssemblageFromFile(string path, AssemblyObject[] objectCatalog, Dictionary<string, int> catalog)
    {
        List<AssemblyObject> assemblage = new List<AssemblyObject>();

        string[][] obj = System.IO.File.ReadAllLines(path).Select(s => s.Split(new[] { ';' })).ToArray();

        for (int i = 0; i < obj.Length; i++)
        {
            // 0. name
            // 1. weight
            // 2. scalar
            // 3. direction
            // 4. handle occupancy = neighbourhandle % handle weight
            // 5. ReferencePlane (OXY, sep. |)

            // 0. name
            // if an object is not in the catalog, skip it
            if (!catalog.ContainsKey(obj[i][0]))
            {
                assemblage.Add(null);
                continue;
            }
            AssemblyObject aObj = new AssemblyObject(objectCatalog[catalog[obj[i][0]]]);
            // 1. weight
            aObj.weight = Convert.ToDouble(obj[i][1]);
            // 2. scalar
            aObj.scalar = Convert.ToDouble(obj[i][2]);
            // 3. direction
            double[] dir = obj[i][3].Split(new[] { ',' }).Select(x => Convert.ToDouble(x)).ToArray();
            Vector3d vDir = new Vector3d(dir[0], dir[1], dir[2]);
            aObj.direction = vDir;
            // 4. handle occupancy = neighbourhandle % handle weight
            string[][] handles = obj[i][4].Split(new[] { ',' }).Select(s => s.Split(new[] { '=', '%' })).ToArray();
            for (int j = 0; j < handles.Length; j++)
            {
                aObj.handles[j].occupancy = Convert.ToInt32(handles[j][0]);
                aObj.handles[j].neighbourHandle = Convert.ToInt32(handles[j][1]);
                aObj.handles[j].weight = Convert.ToDouble(handles[j][2]);
            }
            // 5. ReferencePlane (OXY, sep. |)
            string[][] rPlane = obj[i][5].Split(new[] { '|' }).Select(s => s.Split(new[] { ',' })).ToArray();
            Point3d O = new Point3d(Convert.ToDouble(rPlane[0][0]), Convert.ToDouble(rPlane[0][1]), Convert.ToDouble(rPlane[0][2]));
            Vector3d X = new Vector3d(Convert.ToDouble(rPlane[1][0]), Convert.ToDouble(rPlane[1][1]), Convert.ToDouble(rPlane[1][2]));
            Vector3d Y = new Vector3d(Convert.ToDouble(rPlane[2][0]), Convert.ToDouble(rPlane[2][1]), Convert.ToDouble(rPlane[2][2]));
            Plane rP = new Plane(O,X,Y);
            Transform orient = Transform.PlaneToPlane(aObj.referencePlane, rP);
            aObj.Transform(orient);
            assemblage.Add(aObj);
        }

        return assemblage;
    }

    public DataTree<string> ExtractTopology()
    {
        DataTree<string> topology = new DataTree<string>();

        string s;
        for (int i = 0; i < assemblage.Count; i++)
        {

            foreach (Handle h in assemblage[i].handles)
            {
                if (h.occupancy != -1 && h.occupancy != -2)
                {
                    //                                 nCindex   =       nCtype            |     nChandle
                    s = string.Format("{0}={1}|{2}", h.occupancy, assemblage[h.occupancy].id, h.neighbourHandle);
                }
                else
                {
                    s = h.occupancy.ToString();
                }
                topology.Add(s, new GH_Path(i));
            }
        }

        return topology;
    }

    public string readFileUnique(string path)
    {
        return System.IO.File.ReadAllText(path);
    }

    public string[] readFileByLines(string path)
    {
        return System.IO.File.ReadAllLines(path);
    }
# ---------- end c_script_5 ----------

# ----
# topology map as tree:
# 
# . branch number is component index in assemblage
# 
# . list index is handle index
# 
# . string is:
# nCindex=nCtype|nChandle
# 
# (nC - neighbour component)
panel_8 = Panel("nCindex=nCtype|nChandle")
panel_9 = Panel(c_script_5.AOt)

# ---- group: Assemblage Topology
# nC - neighbour Component index
# 
# nT - neighbour component Type
# 
# nH - neighbour component handle
# (-1 free handle, -2 occluded handle)
c_script_6 = CSharpScript(AOt=c_script_5.AOt)  # -> out, nC, nT, nH; inputs AOt: tree of String
# ---------- c_script_6: C# ----------
    DataTree<int?> neighComp = new DataTree<int?>();
    DataTree<int?> neighType = new DataTree<int?>();
    DataTree<int> neighHand = new DataTree<int>();

    for(int i = 0; i < AOt.BranchCount; i++)
    {
      foreach(string s in AOt.Branches[i])
      {
        int[] data = s.Split(new [] {'|','='}).Select(x => Convert.ToInt32(x)).ToArray();

        if (data.Length == 3)
        {
          neighComp.Add(data[0], AOt.Paths[i]);
          neighType.Add(data[1], AOt.Paths[i]);
          neighHand.Add(data[2], AOt.Paths[i]);
        }else
        {
          neighComp.Add(null, AOt.Paths[i]);
          neighType.Add(null, AOt.Paths[i]);
          neighHand.Add(data[0], AOt.Paths[i]);
        }
      }

    }

    nC = neighComp;
    nT = neighType;
    nH = neighHand;
# ---------- end c_script_6 ----------

# ---- group: extract reference plane
c_script_7 = CSharpScript(AO=c_script_5.AOa, Reference="C:\USERS\ALESS\APPDATA\ROAMING\GRASSHOPPER\LIBRARIES\Assemblage.dll")  # -> P
# ---------- c_script_7: C# usings ----------
using Assemblage;
# ---------- c_script_7: C# ----------
    if (AO == null) return;
    AssemblyObject o = (AssemblyObject) AO;

    P = o.referencePlane;
# ---------- end c_script_7 ----------

# ---- group: extract object id
c_script_8 = CSharpScript(AO=c_script_5.AOa, Reference="C:\USERS\ALESS\APPDATA\ROAMING\GRASSHOPPER\LIBRARIES\Assemblage.dll")  # -> Id
# ---------- c_script_8: C# ----------
    if (AO == null) return;
    AssemblyObject o = (AssemblyObject) AO;

    Id = o.id;
# ---------- end c_script_8 ----------

# ---- group: extract sender handle plane
c_script_9 = CSharpScript(AO=c_script_5.AOa, Reference="C:\USERS\ALESS\APPDATA\ROAMING\GRASSHOPPER\LIBRARIES\Assemblage.dll")  # -> simplify(sH)
# ---------- c_script_9: C# usings ----------
using Assemblage;
using System.Linq;
# ---------- c_script_9: C# ----------
    if (AO == null) return;
    AssemblyObject o = (AssemblyObject) AO;

    sH = o.handles.Select(h => h.s).ToArray();
# ---------- end c_script_9 ----------

# ----
panel_10 = Panel(c_script_6.nH)

# ---- group: extract coarse geometry (meshes)
c_script_10 = CSharpScript(AO=c_script_5.AOa, Reference="C:\USERS\ALESS\APPDATA\ROAMING\GRASSHOPPER\LIBRARIES\Assemblage.dll")  # -> M
# ---------- c_script_10: C# ----------
    if (AO == null) return;
    AssemblyObject o = (AssemblyObject) AO;

    M = o.coarseMesh;
# ---------- end c_script_10 ----------

# ---- group: block0 - id 0 / extra geometry polylines
crv_5 = Curve([<curve referenced from the Rhino model> x3])

# ---- group: block0 - id 0
coresponding_handles_indexes = Panel("""5
4
2""")
group = Group(Objects=crv_5)
geo = Geometry(<brep referenced from the Rhino model>)

# ---- group: block 1 - id 1 / extra geometry polylines
crv_6 = Curve([<curve referenced from the Rhino model> x4])

# ---- group: block 1 - id 1
coresponding_handles_indexes_2 = Panel("""0
3
1
5""")
group_2 = Group(Objects=crv_6)
geo_2 = Geometry(<brep referenced from the Rhino model>)

# ---- group: filter free handles
larger = LargerThan(FirstNumber=c_script_6.nH, SecondNumber="-1")  # -> LargerThan, OrEqualTo

# ---- group: block 1 - id 1 / ref plane 1
pln = Plane(xy_2)

# ---- group: block0 - id 0 / ref plane 0
pln_2 = Plane(xy)

# ----
list = ValueList({"collision meshes": 0, "final geometries": 1}, selected="final geometries")
smesh = SimpleMesh(Brep=geo)
smesh_2 = SimpleMesh(Brep=geo_2)
not = GateNot(A=larger.LargerThan)

# ---- group: brep geometries
weave = Weave(Pattern=graft(c_script_8), Stream0=smesh, Stream1=smesh_2, NullGaps=False)  # -> simplify(flatten(Weave))

# ---- group: polylines
weave_2 = Weave(Pattern=graft(c_script_8), Stream0=group, Stream1=group_2, NullGaps=False)  # -> flatten(Weave)

# ---- group: reference planes
weave_3 = Weave(Pattern=graft(c_script_8), Stream0=pln_2, Stream1=pln, NullGaps=False)  # -> flatten(Weave)

# ---- group: selection indexes
weave_4 = Weave(Pattern=graft(c_script_8), Stream0=coresponding_handles_indexes, Stream1=coresponding_handles_indexes_2, NullGaps=False)  # -> simplify(Weave)

# ----
dispatch = Dispatch(List=c_script_9, DispatchPattern=not)  # -> ListA, ListB

orient = Orient(Geometry=weave_2, Source=weave_3, Target=c_script_7)  # -> Geometry, Transform
orient_2 = Orient(Geometry=weave, Source=weave_3, Target=c_script_7)  # -> Geometry, Transform
filter = StreamFilter(Gate=list, Stream0=c_script_10, Stream1=orient_2.Geometry)

# ---- group: display
visualization_mode = ValueList({"objects": 0, "by occupancy": 1, "by type": 2, "by sequence": 3, "none": 4}, selected="objects")
type_a = ColourSwatch(SwatchColor=RGB(176, 229, 232))
type_b = ColourSwatch(SwatchColor=RGB(80, 107, 110))
merge_6 = Merge(Data1=type_a, Data2=type_b)
cluster = Cluster(int=visualization_mode, mesh=filter, int_2=c_script_6.nH, int_3=c_script_8, G=0, col=merge_6)

# ---- group: free handles
pt = Point(flatten(dispatch.ListA))

# ----
item_2 = ListItem(List=not, Index=weave_4, Wrap=True)
ungroup = Ungroup(Group=orient.Geometry)  # -> simplify(Objects)
panel_11 = Panel(item_2)
dispatch_2 = Dispatch(List=ungroup, DispatchPattern=item_2)  # -> ListA, ListB
crv_7 = Curve(dispatch_2.ListA)
disc = Discontinuity(Curve=crv_7, Level=1)  # -> Points, Parameters

# ---- group: select by point proximity
number_slider = Slider(3000, range=100..10000)
avr = Average(Input=disc.Points)
pt_2 = Point(Point(0, 1522.569652, 4779.701208))
msphere = MeshSphere(Base=pt_2, Radius=number_slider, UCount=10, VCount=20)
f_ptssph = PointsWithinSphere(P=pt_2, C=flatten(avr), R=number_slider)  # -> CP, Ci; inputs P: Point3d, C: list of Point3d, R: Double
# ---------- f_ptssph: C# ----------
                                                                                         /*
    froGH - a sparse collection of (in)utilities for Grasshopper

    Points Within Sphere
    code by Alessio Erioli

    froGH by Co-de-iT is licensed under a Creative Commons Attribution 4.0 International License.
    http://creativecommons.org/licenses/by/4.0/

    */

    if (C == null || C.Count == 0) return;

    pts = C;
    cl.Clear();
    ci.Clear();

    // declare RTree
    RTree tree = new RTree();

    // populate it
    for(int i = 0; i < C.Count; i++)
      tree.Insert(C[i], i);

    // perform search
    tree.Search(new Sphere(P, R), (sender, e) =>
      {
      cl.Add(pts[e.Id]);
      ci.Add(e.Id);
      });

    CP = cl;
    Ci = ci;
# ---------- f_ptssph: C# additional code ----------
  List<Point3d> cl = new List<Point3d>();
  List<int> ci = new List<int>();
  List<Point3d> pts = new List<Point3d>();
# ---------- end f_ptssph ----------
medges = MeshEdges(Mesh=msphere)  # -> NakedEdges, InteriorEdges, NonManifoldEdges

# ---- group: display / display components
panel_12 = Panel("45")
mjoin = MeshJoin(Meshes=cluster)
preview = CustomPreview(
    Geometry=mjoin,
    Material={diffuse=RGB(221, 160, 221), emission=RGB(66, 48, 66), shine=0.5, specular=RGB(255, 255, 255), transparency=0})

# ----
pline = PolyLine(Vertices=disc.Points, Closed="true")

# ---- group: display / display components / extract edges with angle tolerance (many meshes)
f_mmeea = MeshesExtractEdgesWithToleranceAngle(M=filter, A=panel_12)  # -> flatten(Ei), En; inputs M: list of Mesh, A: Double
# ---------- f_mmeea: C# usings ----------
using System.Threading.Tasks;
using System.Collections.Concurrent;
using System.Linq;
# ---------- f_mmeea: C# ----------
          /*
    froGH - a sparse collection of (in)utilities for Grasshopper

    Mesh Extract Edges with tolerance angle - many meshes

    code by Alessio Erioli

    froGH by Co-de-iT is licensed under a Creative Commons Attribution 4.0 International License.
    http://creativecommons.org/licenses/by/4.0/

    */

    InitComp();

    if (M == null) return;

    double num = A / 57.2958;

    ConcurrentBag<GH_Line> list = new ConcurrentBag<GH_Line>();
    ConcurrentBag<GH_Line> list2 = new ConcurrentBag<GH_Line>();


    Parallel.ForEach(M, m =>
      {
      m.Normals.ComputeNormals();
      Rhino.Geometry.Collections.MeshTopologyEdgeList topologyEdges = m.TopologyEdges;
      int num2 = topologyEdges.Count - 1;
      for (int i = 0; i <= num2; i++)
      {
        int[] connectedFaces = topologyEdges.GetConnectedFaces(i);
        if (connectedFaces.Length < 2)
          list2.Add(new GH_Line(topologyEdges.EdgeLine(i)));

        if (connectedFaces.Length == 2)
        {
          Vector3f val2 = m.FaceNormals[connectedFaces[0]];
          Vector3f val3 = m.FaceNormals[connectedFaces[1]];
          double num3 = Vector3d.VectorAngle(new Vector3d((double) val2.X, (double) val2.Y, (double) val2.Z),
            new Vector3d((double) val3.X, (double) val3.Y, (double) val3.Z));
          if (num3 > num)
            list.Add(new GH_Line(topologyEdges.EdgeLine(i)));

        }
      }
      });

    Ei = list;
    En = list2;
# ---------- f_mmeea: C# additional code ----------
  private void InitComp(){
    Component.Name = "Meshes Extract Edges with tolerance angle";
    Component.NickName = "f_MmEEA";
    Component.Description = "Extract Mesh edges with specific angle tolerance.\n\nOptimized for many meshes";
    Component.Params.Input[0].Name = "Meshes";
    Component.Params.Input[0].Description = "The List of Input Meshes to process";
    Component.Params.Input[1].Name = "Angle";
    Component.Params.Input[1].Description = "The Tolerance Angle";
    Component.Params.Output[0].Name = "Internal Edges";
    Component.Params.Output[0].Description = "Internal edges lines under tolerance";
    Component.Params.Output[1].Name = "Naked Edges";
    Component.Params.Output[1].Description = "Naked edges lines";
  }
# ---------- end f_mmeea ----------

# ----
boundary = BoundarySurfaces(Edges=pline)

# ---- group: display / display components / display edges
previewlw = CustomPreviewLineweights(Geometry=f_mmeea.Ei, Shader=ColourSwatch(SwatchColor=RGB(0, 0, 0)), Thickness=Slider(1, range=1..3), Absolute=False)

# ----
list_2 = ValueList({"simple louvers": 0, "noise-driven louvers": 1}, selected="noise-driven louvers")
f_sbpath = SerialBranchPath(T=boundary, i=f_ptssph.Ci)  # -> P, D; inputs T: tree, i: Int32
# ---------- f_sbpath: C# ----------
                                                /*
    froGH - a sparse collection of (in)utilities for Grasshopper

    Serial Branch Path
    code by Alessio Erioli

    froGH by Co-de-iT is licensed under a Creative Commons Attribution 4.0 International License.
    http://creativecommons.org/licenses/by/4.0/

    */

    initComp();


    if (T.BranchCount > 0){
      int ind = i % T.BranchCount;
      P = T.Path(ind);
      D = T.Branches[ind];
    }
# ---------- f_sbpath: C# additional code ----------
  void initComp(){
    Component.Name = "Serial Branch Path";
    Component.NickName = "f_SBPath";
    Component.Description = "Retrieves the data tree path and data for a specific branch serial index";
    Component.Params.Input[0].Name = "Tree";
    Component.Params.Input[0].Description = "the data tree";
    Component.Params.Input[1].Name = "index";
    Component.Params.Input[1].Description = "serial index of branch to sample";
    Component.Params.Output[0].Name = "Path";
    Component.Params.Output[0].Description = "the tree branch path";
    Component.Params.Output[1].Name = "Data";
    Component.Params.Output[1].Description = "the tree branch content";
  }
# ---------- end f_sbpath ----------
gate = StreamGate(Stream=f_sbpath.D, Gate=list_2)  # -> Target0, Target1

# ---- group: simple louvers
sdivide = DivideSurface(Surface=gate.Target0, UCount=10, VCount=10)  # -> Points, Normals, Parameters
amp = Amplitude(Vector=sdivide.Normals, Amplitude=Slider(50, range=10..100))
move = Move(Geometry=sdivide.Points, Motion=amp)  # -> Geometry, Transform
pline_2 = PolyLine(Vertices=move.Geometry, Closed=False)
pline_3 = PolyLine(Vertices=sdivide.Points, Closed=False)
merge_7 = Merge(Data1=graft(pline_3), Data2=graft(pline_2))  # -> simplify(Result)
f_pmloft = PolylineMeshLoft(P=merge_7)  # -> M; inputs P: tree of Polyline, C: list of Boolean
# ---------- f_pmloft: C# usings ----------
using System.Threading.Tasks;
# ---------- f_pmloft: C# ----------
                                                                       /*
    froGH - a sparse collection of (in)utilities for Grasshopper

    Mesh loft from Polylines with same number of points

    code by Alessio Erioli

    froGH by Co-de-iT is licensed under a Creative Commons Attribution 4.0 International License.
    http://creativecommons.org/licenses/by/4.0/

    */

    initComp();

    if (P.BranchCount == 0 || P == null) return;
    if (C == null || C.Count == 0)
    {
      C = new List<bool>();
      C.Add(false);
    }
    Mesh[] meshes = new Mesh[P.BranchCount];

    // generate bool array
    bool[] closedLoft = new bool[P.BranchCount];
    int boolCount = 0;
    for(int i = 0; i < P.BranchCount; i++)
    {
      closedLoft[i] = C[boolCount];
      if (boolCount < C.Count - 1) boolCount++;
    }


    if (P.BranchCount < 1000)
    {
      // sequential loop

      Mesh m1, m0;
      for(int k = 0; k < P.BranchCount; k++)
      {
        // continue if there aren't enough polylines for loft
        // 2 for open loft, 3 for closed loft
        int closed = closedLoft[k] ? 1 : 0;
        if ( P.Branches[k].Count - closed < 2) continue;

        if (closedLoft[k])
        {
          // closed loft
          m0 = new Mesh();
          int pCount,vCount;
          Point3d[] pts0, pts1;
          pCount = P.Branches[k].Count;
          for (int i = 0; i < P.Branches[k].Count; i++){
            pts0 = P.Branches[k][i % pCount].ToArray();
            pts1 = P.Branches[k][(i + 1) % pCount].ToArray();
            vCount = pts0.Length - 1;
            for (int j = 0; j < vCount; j++){
              m1 = new Mesh();
              m1.Vertices.Add(pts0[j]);
              m1.Vertices.Add(pts0[j + 1]);
              m1.Vertices.Add(pts1[j + 1]);
              m1.Vertices.Add(pts1[j]);
              m1.Faces.AddFace(0, 1, 2, 3);
              m0.Append(m1);
            }
          }
        }else
        {
          // open loft
          m0 = new Mesh();
          int vCount;
          Point3d[] pts0, pts1;
          for (int i = 0; i < P.Branches[k].Count - 1; i++){
            pts0 = P.Branches[k][i].ToArray();
            pts1 = P.Branches[k][i + 1].ToArray();
            vCount = pts0.Length - 1;
            for (int j = 0; j < vCount; j++){
              m1 = new Mesh();
              m1.Vertices.Add(pts0[j]);
              m1.Vertices.Add(pts0[j + 1]);
              m1.Vertices.Add(pts1[j + 1]);
              m1.Vertices.Add(pts1[j]);
              m1.Faces.AddFace(0, 1, 2, 3);
              m0.Append(m1);
            }
          }

        }

        m0.Weld(Math.PI * 0.5);
        m0.Normals.ComputeNormals();
        meshes[k] = m0;
      }

    }
    else
    {
      // go parallel
      Parallel.For(0, P.BranchCount, k =>
        //for(int k = 0; k < P.BranchCount; k++)
        {
        Mesh m1, m0;
        // continue if there aren't enough polylines for loft
        // 2 for open loft, 3 for closed loft
        int closed = closedLoft[k] ? 1 : 0;
        if ( P.Branches[k].Count - closed >= 2){

          if (closedLoft[k])
          {
            // closed loft
            m0 = new Mesh();
            int pCount,vCount;
            Point3d[] pts0, pts1;
            pCount = P.Branches[k].Count;
            for (int i = 0; i < P.Branches[k].Count; i++){
              pts0 = P.Branches[k][i % pCount].ToArray();
              pts1 = P.Branches[k][(i + 1) % pCount].ToArray();
              vCount = pts0.Length - 1;
              for (int j = 0; j < vCount; j++){
                m1 = new Mesh();
                m1.Vertices.Add(pts0[j]);
                m1.Vertices.Add(pts0[j + 1]);
                m1.Vertices.Add(pts1[j + 1]);
                m1.Vertices.Add(pts1[j]);
                m1.Faces.AddFace(0, 1, 2, 3);
                m0.Append(m1);
              }
            }
          }else
          {
            // open loft
            m0 = new Mesh();
            int vCount;
            Point3d[] pts0, pts1;
            for (int i = 0; i < P.Branches[k].Count - 1; i++){
              pts0 = P.Branches[k][i].ToArray();
              pts1 = P.Branches[k][i + 1].ToArray();
              vCount = pts0.Length - 1;
              for (int j = 0; j < vCount; j++){
                m1 = new Mesh();
                m1.Vertices.Add(pts0[j]);
                m1.Vertices.Add(pts0[j + 1]);
                m1.Vertices.Add(pts1[j + 1]);
                m1.Vertices.Add(pts1[j]);
                m1.Faces.AddFace(0, 1, 2, 3);
                m0.Append(m1);
              }
            }

          }

          m0.Weld(Math.PI * 0.5);
          m0.Normals.ComputeNormals();
          meshes[k] = m0;
        }
        });
    }

    M = meshes;
# ---------- f_pmloft: C# additional code ----------
  void initComp(){
    Component.Name = "Polyline Mesh Loft";
    Component.NickName = "f_PMLoft";
    Component.Description = "Lofts  polylines with the same number of vertices into a mesh";
    Component.Params.Input[0].Name = "Polylines";
    Component.Params.Input[0].Description = "Lists of polylines to interpolate as mesh loft";
    Component.Params.Input[1].Name = "Closed";
    Component.Params.Input[1].Description = "True for closed loft, False for open loft";
    Component.Params.Output[0].Name = "Mesh";
    Component.Params.Output[0].Description = "Mesh Loft";
  }
# ---------- end f_pmloft ----------
mjoin_2 = MeshJoin(Meshes=flatten(f_pmloft))
preview_2 = CustomPreview(Geometry=mjoin_2, Material=ColourSwatch(SwatchColor=RGB(38, 17, 5)))

# ----
subset = SubList(List=flatten(gate.Target1), Domain="50", Wrap=True)  # -> List, Index
height = Slider(50, range=0..100)
list_3 = ValueList({"sample": 0, "ALL OF THE SURFACES!!!!": 1}, selected="ALL OF THE SURFACES!!!!")
filter_2 = StreamFilter(Gate=list_3, Stream0=subset.List, Stream1=gate.Target1)
sqrt = SquareRoot(Value="2")

# ---- group: noise-driven louvers / basic louver
number_slider_2 = Slider(5, range=0..100)

# ----
f_cdom = CenteredDomain(L=number_slider_2)  # -> D; inputs L: Double
# ---------- f_cdom: C# ----------
    /*
    froGH - a sparse collection of(in)utilities for Grasshopper

    Centered Domain
      code by Alessio Erioli

      froGH by Co-de - iT is licensed under a Creative Commons Attribution 4.0 International License.
    http://creativecommons.org/licenses/by/4.0/

      */
    
    initComp();
    D = new Interval(-L * 0.5, L * 0.5);
# ---------- f_cdom: C# additional code ----------
  void initComp(){
    Component.Name = "Centered Domain";
    Component.NickName = "f_CDom";
    Component.Description = "Generates a domain of length L, centered in 0";
    Component.Params.Input[0].Name = "Domain Length";
    Component.Params.Input[0].Description = "the domain length";
    Component.Params.Output[0].Name = "Domain";
    Component.Params.Output[0].Description = "the generated domain";
  }
# ---------- end f_cdom ----------

# ---- group: noise-driven louvers
number_slider_3 = Slider(10, range=5..20)
# NOTE: The process takes a lot to complete with the full set of polylines in the assemblage - use carefully!!!!
mesh_uv = MeshSurface(Surface=filter_2, UCount=number_slider_3, VCount=number_slider_3, Overhang=True, Equalize=False)  # -> simplify(Mesh)
facen = FaceNormals(Mesh=mesh_uv)  # -> Centers, Normals
pl = PlaneNormal(Origin=facen.Centers, ZAxis=facen.Normals)
mjoin_3 = MeshJoin(Meshes=flatten(mesh_uv))

# ----
division = Division(A="500", B=number_slider_3)
f_cdom_2 = CenteredDomain(L=division)  # -> D; inputs L: Double; same code as f_cdom

# ---- group: noise-driven louvers / basic louver (continued)
box = DomainBox(Base=PlaneXY(0, 0, 0), X=f_cdom_2, Y=f_cdom, Z=height)
mbox = MeshBox(Base=box, XCount="1", YCount="1", ZCount="1")

# ----
scale_nu = ScaleNU(Geometry=mbox, Plane=PlaneXY(0, 0, 0), ScaleX=sqrt, ScaleY=1, ScaleZ=1)  # -> Geometry, Transform

# ---- group: noise-driven louvers / discrete rotation by noise
perlin = PerlinNoise(Values=facen.Centers, Time=Slider(0, range=0..10), Scale=Slider(0.002, range=0..1))
panel_13 = Panel("3")
panel_14 = Panel("Pi*0.25")

# ----
qmult = QuickMultiply(A=perlin, B=panel_13)

# ---- group: noise-driven louvers / discrete rotation by noise (continued)
int = Integer(qmult)

# ----
qmult_2 = QuickMultiply(A=int, B=panel_14)
qabs = QuickAbs(A=int)
qeq = QuickEq(A=qabs, B="1")
weave_5 = Weave(Pattern=graft(qeq), Stream0=mbox, Stream1=scale_nu.Geometry, NullGaps=False)
pshift = ShiftPaths(Data=weave_5, Offset=-1)

# ---- group: noise-driven louvers (continued)
prot = RotatePlane(Plane=pl, Angle=qmult_2)
orient_3 = Orient(Geometry=pshift, Source=PlaneXY(0, 0, 0), Target=prot)  # -> Geometry, Transform
mjoin_4 = MeshJoin(Meshes=flatten(orient_3.Geometry))

# ----
surfaces = ColourSwatch(SwatchColor=RGB(171, 171, 171))
louvers = ColourSwatch(SwatchColor=RGB(69, 15, 15))
preview_3 = CustomPreview(Geometry=mjoin_3, Material=surfaces)
preview_4 = CustomPreview(Geometry=mjoin_4, Material=louvers)

# ==== cluster Cluster
int = ClusterInput()
mesh = ClusterInput()
int_2 = ClusterInput()
col = ClusterInput()
int_3 = ClusterInput()
int_4 = Integer(int)
mesh_2 = Mesh(mesh)
int_5 = Integer(int_2)
col_2 = Colour(col)
int_6 = Integer(int_3)
gate = StreamGate(Stream=mesh_2, Gate=int_4)  # -> Target0, Target1, Target2, Target3, Target4
equals = Equality(FirstNumber=int_5, SecondNumber="-1")  # -> Equality, Inequality
G = ClusterInput()
f_massbool = MassBoolean(V=equals.Equality, type=1)  # -> B; inputs V: list of Boolean, type: Int32
# ---------- f_massbool: C# ----------
  /*
    froGH - a sparse collection of (in)utilities for Grasshopper

    mass boolean
    code by Alessio Erioli

    froGH by Co-de-iT is licensed under a Creative Commons Attribution 4.0 International License.
    http://creativecommons.org/licenses/by/4.0/

    */
    initComp();

    bool r;
    if (type == 0) {
      Component.Message = "AND";
      r = true;
    }else{
      Component.Message = "OR";
      r = false;
    }


    for (int i = 0; i < V.Count; i++){
      if (type == 0) {
        r = r && V[i];
      }
      else{
        r = r || V[i];
      }
    }
    B = r;
# ---------- f_massbool: C# additional code ----------
  void initComp(){
    Component.Name = "Mass Boolean";
    Component.NickName = "f_MassBool";
    Component.Description = "Mass boolean operator on a list of values";
    Component.Params.Input[0].Name = "Values";
    Component.Params.Input[0].Description = "boolean values as list";
    Component.Params.Input[1].Name = "Boolean operator";
    Component.Params.Input[1].Description = "type of operator: 0 AND, 1 OR";
    Component.Params.Output[0].Name = "Boolean result";
    Component.Params.Output[0].Description = "the result";

  }
# ---------- end f_massbool ----------
filter = StreamFilter(Gate=G, Stream0=gate.Target3)

# ---- group: display by assemblage sequence
lng = ListLength(List=filter)  # -> expr("x-1", Length)
f_ifroml = IndexesFromList(D=filter)  # -> i; inputs D: list
# ---------- f_ifroml: C# usings ----------
using System.Linq;
# ---------- f_ifroml: C# ----------
   
 /*
    froGH - a sparse collection of (in)utilities for Grasshopper

    Indexes from Number
    code by Alessio Erioli

    froGH by Co-de-iT is licensed under a Creative Commons Attribution 4.0 International License.
    http://creativecommons.org/licenses/by/4.0/

    */
    initComp();
   
    GH_Integer[] indexes = new GH_Integer[D.Count];

    for(int j = 0; j < D.Count; j++)
      indexes[j] = new GH_Integer(j);

    //A = indexes.Sum(j => j.Value); // uses System.Linq Sum selector function - for each GH_Integer j in indexes add its value to the total sum

    i = indexes;
# ---------- f_ifroml: C# additional code ----------
  void initComp(){
    Component.Name = "Indexes from List";
    Component.NickName = "f_iFromL";
    Component.Description = "Generates a list of 0-based integer indexes from a given list of data";
    Component.Params.Input[0].Name = "Data";
    Component.Params.Input[0].Description = "the list to index";
    Component.Params.Output[0].Name = "Indexes";
    Component.Params.Output[0].Description = "the generated indexes";
  }
# ---------- end f_ifroml ----------
one_over_x = OneOverX(Value=lng)
multiplication = Multiplication(A=f_ifroml, B=one_over_x)
sqr = Square(Value=multiplication)
gradient = Gradient(
    LowerLimit=0,
    UpperLimit=1,
    Parameter=sqr,
    stops=[0: RGB(0, 0, 0), 0.498: RGB(56, 136, 150), 0.904: RGB(186, 224, 224), 1: RGB(255, 255, 255)])
mcol = MeshColours(Mesh=graft(filter), Colours=graft(gradient))  # -> flatten(Mesh)

# ---- group: occupied/available visualization
saturated = ColourSwatch(SwatchColor=RGB(194, 199, 137))
available = ColourSwatch(SwatchColor=RGB(255, 255, 255))
weave = Weave(Pattern=f_massbool, Stream0=saturated, Stream1=available, NullGaps=False)  # -> simplify(Weave)
mcol_2 = MeshColours(Mesh=graft(gate.Target1), Colours=weave)  # -> flatten(Mesh)

# ----
item = ListItem(List=col_2, Index=graft(int_6), Wrap=True)  # -> simplify(Item)

# ---- group: display by component type
mcol_3 = MeshColours(Mesh=graft(gate.Target2), Colours=item)  # -> flatten(Mesh)

# ----
mcol_4 = MeshColours(Mesh=gate.Target0, Colours=ColourSwatch(SwatchColor=RGB(255, 255, 255)))
filter_2 = StreamFilter(Gate=int_4, Stream0=mcol_4, Stream1=mcol_2, Stream2=mcol_3, Stream3=mcol)
mesh_3 = Mesh(filter_2)
mesh_4 = ClusterOutput(mesh_3)
